# Dynamo graph TableInput-v2-winForms.dyn (Dynamo 2.18.1.5096)
# packages: GenerativeDesign 6.0.2.0, Clockwork for Dynamo 2.x 2.3.0

python_script = Python()  # CPython3; unwired: IN[0]
# ---------- python_script.python (24 lines) ----------
# Load the Python Standard and DesignScript Libraries
import sys
import clr
clr.AddReference('ProtoGeometry')
from Autodesk.DesignScript.Geometry import *

# The inputs to this node will be stored as a list in the IN variables.
dataEnteringNode = IN

# Place your code below this line
import clr
clr.AddReference('System.Windows.Forms')
from System.Windows.Forms import MessageBox,MessageBoxButtons, MessageBoxIcon

# Define the custom content as a string
rank = "Welcome to our Revit Plugin! Harness the power of Fuzzy Analytical Hierarchy Process (FAHP) Method for informed decision-making in building system selection. Simplify your choices, and optimize efficiency."
#rank="1st Alternative Score is " +str(round(final.iloc[:,1].sum(),3))+"\n2nd Alternative Score is " +str(round(final.iloc[:,2].sum(),3))
# Define the font for the message box


# Show the MessageBox with custom settings
result = MessageBox.Show(None, rank, "FAHAP UI", MessageBoxButtons.OK, MessageBoxIcon.Information)
# Assign your output to the OUT variable.
OUT = 0
# ----------------------------------------
python_script_2 = Python(IN[0]=python_script)  # CPython3
# ---------- python_script_2.python (155 lines) ----------
# Load the Python Standard and DesignScript Libraries
import sys
import clr
clr.AddReference('ProtoGeometry')
from Autodesk.DesignScript.Geometry import *

# The inputs to this node will be stored as a list in the IN variables.
dataEnteringNode = IN

# Place your code below this line
import clr
clr.AddReference('System.Windows.Forms')
clr.AddReference('System.Drawing')

import pandas as pd
from System.Windows.Forms import Form, Button, DataGridView, DataGridViewAutoSizeColumnsMode,  DataGridViewTextBoxColumn,Label,PictureBox,FormStartPosition,PictureBoxSizeMode,DockStyle
from System.Drawing import Point, Size, Image, Bitmap,Font,FontFamily


def create_form_with_table():
    class DynamicForm(Form):
        def __init__(self):
            # Initialize the form
            self.Text = "FAHP User Input Interface"
            self.ClientSize = Size(700,550)
            
            # Create a label for the whole menu
            self.title_label = Label()
            self.title_label.Text = "Introduction"
            self.title_label.Location = Point(20, 20)
            self.title_label.AutoSize = True
            font = Font(FontFamily.GenericSansSerif,
            12, 1) 
            self.title_label.Font=font
            self.Controls.Add(self.title_label)
            
            # Create a label for the whole menu
            self.intro_label = Label()
            self.intro_label.Text = "During this process wherever suitable the plugin connects to the Revit model to generate the required information and assist the user in inputting information. Moreover, at each step user is provided with two help buttons for more clarification."
            self.intro_label.Location = Point(30, 50)
            self.intro_label.Size = Size(670,60)
            font = Font(FontFamily.GenericSansSerif,
            9, 0) 
            self.intro_label.Font=font
            self.Controls.Add(self.intro_label)
            
            # Create a label for the whole menu
            self.process_label = Label()
            self.process_label.Text = "This process is designed in 7 steps as following:"
            self.process_label.Location = Point(30, 110)
            self.process_label.Size = Size(670,30)
            font = Font(FontFamily.GenericSansSerif,
            9, 0) 
            self.process_label.Font=font
            self.Controls.Add(self.process_label)
             # Create a label for the step1
            self.process_step1 = Label()
            self.process_step1.Text = "Step1: Providing Project spaciatial information (ZIP-Code) and the main Floor Families to measure project Size"  
            self.process_step1.Location = Point(50, 150)
            self.process_step1.Size = Size(650,60)
            font = Font(FontFamily.GenericSansSerif,
            9, 0) 
            self.process_step1.Font=font
            self.Controls.Add(self.process_step1)
            
             # Create a label for the step 2
            self.process_step2 = Label()
            self.process_step2.Text = "Step2: Selecting the two design alternatives"      
            self.process_step2.Location = Point(50, 210)
            self.process_step2.Size = Size(670,30)
            font = Font(FontFamily.GenericSansSerif,
            9, 0) 
            self.process_step2.Font=font
            self.Controls.Add(self.process_step2)

             # Create a label for the step 3
      
            self.process_step3 = Label()
            self.process_step3.Text = "Step3: Weighting the main assessment Criteria "
            self.process_step3.Location = Point(50, 270)
            self.process_step3.AutoSize = True
            font = Font(FontFamily.GenericSansSerif,
            9, 0) 
            self.process_step3.Font=font
            self.Controls.Add(self.process_step3)
            
            # Create a label for the step 4
      
            self.process_step4 = Label()
            self.process_step4.Text = "Step4: Weighting the sub-Criteria for each main cariterian  "
            self.process_step4.Location = Point(50, 330)
            self.process_step4.AutoSize = True
            font = Font(FontFamily.GenericSansSerif,
            8, 0) 
            self.process_step4.Font=font
            self.Controls.Add(self.process_step4)
            
            # Create a label for the step 5
      
            self.process_step5 = Label()
            self.process_step5.Text = "Step5: Weighting the performance of design alternatives in each sub-criterian "
            self.process_step5.Location = Point(50, 390)
            self.process_step5.AutoSize = True
            font = Font(FontFamily.GenericSansSerif,
            8, 0) 
            self.process_step5.Font=font
            self.Controls.Add(self.process_step5)  
                      
            # Create a button to submit the input
            self.submit_button = Button()
            self.submit_button.Text = "Next"
            self.submit_button.Location = Point(300,450)
            self.submit_button.Click += self.submit_button_click
            self.Controls.Add(self.submit_button)
            

            #Create Logo box
            # Load the photo
            path=r"D:\Nariman Saze\narbiman2.png"
            photo_path = path  
            photo_image= Image.FromFile(photo_path)

            # Create a picture box to display the photo
            self.logo_box = PictureBox()
            self.logo_box.Location = Point(580,450)
            self.logo_box.Size=Size(100,100)
            self.logo_box.Image = photo_image
            self.logo_box.SizeMode = PictureBoxSizeMode.Zoom
            self.Controls.Add(self.logo_box)


            

        def submit_button_click(self, sender, args):
            # Event handler for submit button click
 
            self.Close()

                       


    # Create an instance of the dynamic form
    form = DynamicForm()
    form.ShowDialog()
    
    


# Example usage:
l=1

create_form_with_table()

# Assign your output to the OUT variable.
OUT = 1
# ----------------------------------------

# group: ZipCode and Family Input
categories = Categories("OST_Floors")
all_family_types_of_category = Custom[All Family Types Of Category](category=categories@L1)  # package Clockwork for Dynamo 2.x; Gets all family types/symbols of a given category in the model.
flatten = List.Flatten(list=all_family_types_of_category)
python_script_3 = Python(IN[0]=flatten, IN[1]=python_script_2)  # CPython3
# ---------- python_script_3.python (113 lines) ----------
# Load the Python Standard and DesignScript Libraries
import sys
import clr
clr.AddReference('ProtoGeometry')
clr.AddReference('System.Windows.Forms')
clr.AddReference('System.Drawing')
from Autodesk.DesignScript.Geometry import *
from System.Windows.Forms import Form, Label, Button, TextBox, ComboBox, TreeNode, TreeView,PictureBox,PictureBoxSizeMode
from System.Drawing import Point, Size,Image
# The inputs to this node will be stored as a list in the IN variables.
dataEnteringNode = IN

# Place your code below this line
familyList=IN[0]
familyName=[str(x) for x in familyList]
familyDict=dict(zip(familyName,familyList))

class MyForm(Form):
    def __init__(self):
        # Initialize the form
        self.Text = "FAHP User Input Interface"
        self.ClientSize = Size(350, 400)

        # Create a label for the text input
        self.label = Label()
        self.label.Text = "Enter Project ZipCode:"
        self.label.Location = Point(20, 20)
        self.label.AutoSize = True
        self.Controls.Add(self.label)

        # Create a textbox for the user input
        self.textbox = TextBox()
        self.textbox.Location = Point(20, 40)
        self.textbox.Size = Size(200, 20)
        self.Controls.Add(self.textbox)

        # Create a label for the dropdown
        #self.dropdown_label = Label()
        #self.dropdown_label.Text = "Select an option:"
        #self.dropdown_label.Location = Point(20, 80)
        #self.dropdown_label.AutoSize = True
        #self.Controls.Add(self.dropdown_label)

        # Create a dropdown (combobox) for the user input
        #self.dropdown = ComboBox()
        #self.dropdown.Location = Point(20, 110)
        #self.dropdown.Size = Size(200, 20)
        #self.dropdown.Items.AddRange(["Option 1", "Option 2", "Option 3"])  # Predefined options
        #self.Controls.Add(self.dropdown)

        # Create a label for the treeview
        self.tree_label = Label()
        self.tree_label.Text = "Select Main Floor Families:"
        self.tree_label.Location = Point(20, 80)
        self.tree_label.AutoSize = True
        self.Controls.Add(self.tree_label)

        # Create a treeview for the user input
        self.treeview = TreeView()
        self.treeview.Location = Point(20, 100)
        self.treeview.Size = Size(300, 200)
        self.treeview.CheckBoxes = True  # Enable checkboxes for multiple selections
        for family in familyName:
           self.treeview.Nodes.Add(family)  # Add a root node
        
        self.Controls.Add(self.treeview)

        # Create a button to submit the input
        self.submit_button = Button()
        self.submit_button.Text = "Submit"
        self.submit_button.Location = Point(20, 320)
        self.submit_button.Click += self.submit_button_click
        self.Controls.Add(self.submit_button)
            
        #Create Logo box
        path=r"D:\Nariman Saze\narbiman2.png"
        photo_path = path  
        photo_image = Image.FromFile(photo_path)

        # Create a picture box to display the photo
        self.logo_box = PictureBox()
        self.logo_box.Location = Point(220,300)
        self.logo_box.Size=Size(100,100)
        self.logo_box.Image = photo_image
        self.logo_box.SizeMode = PictureBoxSizeMode.Zoom
        
        self.Controls.Add(self.logo_box)
            
    def submit_button_click(self, sender, args):
        # Event handler for submit button click
        global selected_items,zipCode
        selected_items=[]
        # Clear the list before adding new items
        selected_items.clear()
        # Get selected nodes from the treeview recursively
        self.get_selected_nodes(self.treeview.Nodes)
        zipCode = self.textbox.Text
        self.Close()
    def get_selected_nodes(self, nodes):
        # Recursively iterate through all nodes and their children
        for node in nodes:
            if node.Checked:
                selected_items.append(familyDict[node.Text])
            self.get_selected_nodes(node.Nodes)


# Create an instance of the form
form = MyForm()
form.ShowDialog()


# Assign your output to the OUT variable.
OUT = selected_items,zipCode
# ----------------------------------------

# group: FamilySelection UI
categories_2 = Categories("OST_Walls")
all_family_types_of_category_2 = Custom[All Family Types Of Category](category=categories_2)
name = FamilyType.Name(familyType=all_family_types_of_category_2)
python_script_4 = Python(IN[0]=all_family_types_of_category_2, IN[1]=name, IN[2]=python_script_3)  # CPython3
# ---------- python_script_4.python (114 lines) ----------
# Load the Python Standard and DesignScript Libraries
import sys
import clr
clr.AddReference('ProtoGeometry')
clr.AddReference('System.Windows.Forms')
clr.AddReference('System.Drawing')
from Autodesk.DesignScript.Geometry import *
from System.Windows.Forms import Form, Label, Button, TextBox, ComboBox, TreeNode, TreeView,PictureBox,PictureBoxSizeMode
from System.Drawing import Point, Size,Image
# The inputs to this node will be stored as a list in the IN variables.
dataEnteringNode = IN

# Place your code below this line
familyList=IN[0]
familyName=IN[1]
#familyName=[str(x) for x in familyList]
familyDict=dict(zip(familyName,familyList))

class MyForm(Form):
    def __init__(self):
        # Initialize the form
        self.Text = "FAHP User Input Interface"
        self.ClientSize = Size(350, 400)


        # Create a label for the dropdown(ALT1)
        self.dropdown_label_1 = Label()
        self.dropdown_label_1.Text = "Select a Family for Alternative 1:"
        self.dropdown_label_1.Location = Point(20, 30)
        self.dropdown_label_1.AutoSize = True
        self.Controls.Add(self.dropdown_label_1)

        # Create a dropdown (combobox) for the user input
        self.dropdown_1 = ComboBox()
        self.dropdown_1.Location = Point(20, 60)
        self.dropdown_1.Size = Size(200, 20)
        self.dropdown_1.Items.AddRange(familyName)  
        self.Controls.Add(self.dropdown_1)
        
        # Create a label for the dropdown(ALT2)
        self.dropdown_label_2 = Label()
        self.dropdown_label_2.Text = "Select a Family for Alternative 2:"
        self.dropdown_label_2.Location = Point(20, 110)
        self.dropdown_label_2.AutoSize = True
        self.Controls.Add(self.dropdown_label_2)

        # Create a dropdown (combobox) for the user input
        self.dropdown_2 = ComboBox()
        self.dropdown_2.Location = Point(20, 130)
        self.dropdown_2.Size = Size(200, 20)
        self.dropdown_2.Items.AddRange(familyName)  
        self.Controls.Add(self.dropdown_2)
        # Create a label for the treeview
        #self.tree_label = Label()
        #self.tree_label.Text = "Select Main Floor Families:"
        #self.tree_label.Location = Point(20, 80)
        #self.tree_label.AutoSize = True
        #self.Controls.Add(self.tree_label)

        # Create a treeview for the user input
        #self.treeview = TreeView()
        #self.treeview.Location = Point(20, 100)
        #self.treeview.Size = Size(300, 200)
        #self.treeview.CheckBoxes = True  # Enable checkboxes for multiple selections
        #for family in familyName:
           #self.treeview.Nodes.Add(family)  # Add a root node
        
        #self.Controls.Add(self.treeview)

        # Create a button to submit the input
        self.submit_button = Button()
        self.submit_button.Text = "Submit"
        self.submit_button.Location = Point(20, 320)
        self.submit_button.Click += self.submit_button_click
        self.Controls.Add(self.submit_button)
            
        #Create Logo box
      

        # Load the photo
        path=r"D:\Nariman Saze\narbiman2.png"
        photo_path = path  # Update with the path to your photo
        photo_image = Image.FromFile(photo_path)

        # Create a picture box to display the photo
        self.logo_box = PictureBox()
        self.logo_box.Location = Point(220,300)
        self.logo_box.Size=Size(100,100)
        self.logo_box.Image = photo_image
        self.logo_box.SizeMode = PictureBoxSizeMode.Zoom
        
        self.Controls.Add(self.logo_box)
            
    def submit_button_click(self, sender, args):
        # Event handler for submit button click
        global selected_items
        #selected_items.clear()
        selected_items=[self.dropdown_1.SelectedItem,self.dropdown_2.SelectedItem]
        # Clear the list before adding new items
        
        # Get selected nodes from the treeview recursively
        
        #zipCode = self.textbox.Text
        self.Close()



# Create an instance of the form
form = MyForm()
form.ShowDialog()


# Assign your output to the OUT variable.
OUT = [[familyDict[selected_items[0]],familyDict[selected_items[1]]],selected_items]
# ----------------------------------------
code_block = CodeBlock(alternatives=python_script_4) { alternatives; alter_names=alternatives[1]; alter_items=alternatives[0]; }

python_script_5 = Python(IN[0]=code_block.alternatives)  # CPython3
# ---------- python_script_5.python (125 lines) ----------
# Load the Python Standard and DesignScript Libraries
import sys
import clr
clr.AddReference('ProtoGeometry')
clr.AddReference('System.Windows.Forms')
clr.AddReference('System.Drawing')
from Autodesk.DesignScript.Geometry import *
from System.Windows.Forms import Form, Label, Button, TextBox, ComboBox, TreeNode, TreeView,PictureBox,PictureBoxSizeMode
from System.Drawing import Point, Size,Image
# The inputs to this node will be stored as a list in the IN variables.
dataEnteringNode = IN

# Place your code below this line
familyList=IN[0]
familyName=[str(x) for x in familyList]
familyDict=dict(zip(familyName,familyList))

class MyForm(Form):
    def __init__(self):
        # Initialize the form
        self.Text = "Importance Selection Menu"
        self.ClientSize = Size(750, 900)
        
        self.dropdowns=[]

        # Create a label for the whole menu
        self.dropdown_label = Label()
        self.dropdown_label.Text = "Select Importance of Each Criteria and its Subs:"
        self.dropdown_label.Location = Point(20, 20)
        self.dropdown_label.AutoSize = True
        self.Controls.Add(self.dropdown_label)
        
        subs=[[1,2],[3,4,5,6],[7,8,9,10],[11,12,13,14,15],[16,17,18],[19],[20,21]]
        mainNames=["Project Charechteristic","Supply Chain","Time","Cost","Quality","Procurement","Socio-cultural"]
        subNames=[["Location","Project Design"],["Financing","Available Manufactorer","Available Infrastructure","Experts/Skilled Workers"],["Design Period","Production Time","Mobilization/Transfer time","Assembly/Construction period"],["Design","Manufacturing","Logistics","Assembly/Construction","Maintenance"],["DfMA + disassembly","Standards/Protocols","Sustainability"],["Procurement/delivery method"],["Cultural resistance","Local authority regulation"]]
        startY=40
        for i in range(len(subs)):
           if i<3:
               startX=20
           elif i==3:
               startY=40 
               startX=300  
           elif i==6:
               startY=40
               startX=550 
           else:
               startX=300
           
           # Create a label for D
           self.dropdown_label = Label()
           self.dropdown_label.Text = "D"+str(i+1)+": "+mainNames[i]
           self.dropdown_label.Location = Point(startX, startY+5)
           self.dropdown_label.AutoSize = True
           self.Controls.Add(self.dropdown_label)
        
           # Create a dropdown (combobox) for the user input
           self.dropdown = ComboBox()
           self.dropdown.Location = Point(startX+30, startY+30)
           self.dropdown.Size = Size(100, 20)
           self.dropdown.Items.AddRange(["L", "M", "H", "VH"])  # Predefined options
           self.Controls.Add(self.dropdown) 
           startY=startY+60
        
           for k in range(len(subs[i])):
              # Create a label for D2
              self.dropdown_label = Label()
              self.dropdown_label.Text = "F"+str(subs[i][k])+": "+subNames[i][k]
              self.dropdown_label.Location = Point(startX+20, startY+5)
              self.dropdown_label.AutoSize = True
              self.Controls.Add(self.dropdown_label)
        
              # Create a dropdown (combobox) for the user input
              self.dropdown = ComboBox()
              self.dropdown.Location = Point(startX+50, startY+30)
              self.dropdown.Size = Size(80, 20)
              self.dropdown.Items.AddRange(["L", "M", "H", "VH"])  # Predefined options
              self.Controls.Add(self.dropdown)
              # Add the dropdown to the list
              self.dropdowns.append(self.dropdown)  
              startY=startY+60
           startY=startY+15

        # Create a button to submit the input
        self.submit_button = Button()
        self.submit_button.Text = "Submit"
        self.submit_button.Location = Point(610, 642)
        self.submit_button.Click += self.submit_button_click
        self.Controls.Add(self.submit_button)
                #Create Logo box
      

        # Load the photo
        path=r"D:\Nariman Saze\narbiman2.png"
        photo_path = path  # Update with the path to your photo
        photo_image = Image.FromFile(photo_path)

        # Create a picture box to display the photo
        self.logo_box = PictureBox()
        self.logo_box.Location = Point(600,680)
        self.logo_box.Size=Size(100,100)
        self.logo_box.Image = photo_image
        self.logo_box.SizeMode = PictureBoxSizeMode.Zoom
        
        self.Controls.Add(self.logo_box)

    def submit_button_click(self, sender, args):
        # Event handler for submit button click
        global inputs
        inputs=[]
        # Get selected nodes from the treeview recursively
        for dropdown in self.dropdowns:
            inputs.append(dropdown.SelectedItem)
        d1 = self.dropdown.Text
        #close the window
        self.Close()



# Create an instance of the form
form = MyForm()
form.ShowDialog()


# Assign your output to the OUT variable.
OUT = inputs
# ----------------------------------------

# group: Area Calculator
code_block_2 = CodeBlock(userIN=python_script_3, qualitativeAssessment=python_script_5) { userIN; families=userIN[0]; zipCode=userIN[1]; qualitativeAssessment; }
flatten_2 = List.Flatten(list=code_block_2.families)
all_elements_of_family_type = Custom[All Elements of Family Type+](familyType=flatten_2)  # package Clockwork for Dynamo 2.x; Unlike the built-in node, this node retrieves all placed instances of a given loadable *or* system family type
code_block_3 = CodeBlock { "Area"; }
getParameterValueByName = Element.GetParameterValueByName(element=all_elements_of_family_type, parameterName=code_block_3)
flatten_3 = List.Flatten(list=getParameterValueByName)
sum = Math.Sum(values=flatten_3)
python_script_6 = Python()  # CPython3; frozen; unwired: IN[0], IN[1]
# ---------- python_script_6.python (61 lines) ----------
# Load the Python Standard and DesignScript Libraries
import sys
import clr
clr.AddReference('ProtoGeometry')
from Autodesk.DesignScript.Geometry import *

# The inputs to this node will be stored as a list in the IN variables.
dataEnteringNode = IN

# Place your code below this line
import clr
clr.AddReference('System.Windows.Forms')
clr.AddReference('System.Drawing')

from System.Windows.Forms import Form, Label, Button, ComboBox
from System.Drawing import Point, Size

class MyForm(Form):
    def __init__(self):
        # Initialize the form
        self.Text = "User Input Form"
        self.ClientSize = Size(350, 400)
        self.dropdowns = []  # List to hold dropdown controls

        # Create and populate dropdowns dynamically
        for i in range(3):  # Create 3 dropdowns
            label = Label()
            label.Text = f"Dropdown {i + 1}:"
            label.Location = Point(20, 20 + 70 * i)
            label.AutoSize = True
            self.Controls.Add(label)

            dropdown = ComboBox()
            dropdown.Location = Point(20, 40 + 70 * i)
            dropdown.Size = Size(200, 20)
            dropdown.Items.AddRange(["Option 1", "Option 2", "Option 3"])  # Predefined options
            self.Controls.Add(dropdown)
            self.dropdowns.append(dropdown)  # Add the dropdown to the list

        # Create a button to submit the input
        self.submit_button = Button()
        self.submit_button.Text = "Submit"
        self.submit_button.Location = Point(20, 320)
        self.submit_button.Click += self.submit_button_click
        self.Controls.Add(self.submit_button)

    def submit_button_click(self, sender, args):
        # Event handler for submit button click
        global selected_values
        selected_values = []
        # Iterate through the list of dropdowns and retrieve selected values
        for dropdown in self.dropdowns:
            selected_values.append(dropdown.SelectedItem)
        print("Selected values:", selected_values)

# Create an instance of the form
form = MyForm()
form.ShowDialog()

# Assign your output to the OUT variable.
OUT = selected_values
# ----------------------------------------

# group: Main Criteria D
code_block_4 = CodeBlock(area=sum)
# ---------- code_block_4.designscript (2 lines) ----------
["D1-Project Charechteristic","D2-Supply Chain","D3-Time","D4-Cost","D5-Quality","D6-Procurement","D7-Socio Cultural"];
area;
# ----------------------------------------
python_script_7 = Python(IN[0]=code_block_4.out0)  # CPython3
# ---------- python_script_7.python (279 lines) ----------
# Load the Python Standard and DesignScript Libraries
import sys
import clr
clr.AddReference('ProtoGeometry')
from Autodesk.DesignScript.Geometry import *

# The inputs to this node will be stored as a list in the IN variables.
dataEnteringNode = IN

# Place your code below this line
import clr
import numpy as np
clr.AddReference('System.Windows.Forms')
clr.AddReference('System.Drawing')
 
import pandas as pd
from System.Windows.Forms import Form, Button, DataGridView, DataGridViewAutoSizeColumnsMode,  DataGridViewTextBoxColumn,Label,PictureBox,FormStartPosition,PictureBoxSizeMode,DockStyle,DataGridViewCellStyle,DataGridViewHeaderBorderStyle
from System.Drawing import Point, Size, Image, Color,Bitmap,Font,FontFamily

def consistency(table):
    error=[]
    random_index={1:0,2:0,3:0.58,4:0.96,5:1.12,6:1.24,7:1.32,8:1.41,9:1.45}
    data=table
    data_orig=table
    data=np.array(data)
    data_orig=np.array(data_orig)
    priority=[1,1,1,1,1,1,1]
    differ_priority=np.array([1,1,1,1,1,1,1])
    while differ_priority.sum()!=0:
        sum_rows=data.sum(axis=1)
        priority_new=sum_rows/sum_rows.sum()
        differ_priority=np.round(priority_new-priority,9)

        data=data.dot(data)
        priority=priority_new
    overal=data_orig.dot(priority)
    n=len(data[0])
    max_lambda=(overal/priority).sum()/n   
    ci_index=(max_lambda-n)/(n-1)
    con_ratio=ci_index/random_index[n]
    return(round(con_ratio,3))
    
def help(path):
   class PhotoForm(Form):
        def __init__(self):
            # Initialize the photo form
            self.Text = "Photo Form"
            self.ClientSize = Size(800, 600)
            #self.StartPosition = FormStartPosition.CenterScreen

            # Load the photo
            photo_path = path  # Update with the path to your photo
            photo_image = Image.FromFile(photo_path)

            # Create a picture box to display the photo
            self.picture_box = PictureBox()
            self.picture_box.Image = photo_image
            self.picture_box.SizeMode = PictureBoxSizeMode.Zoom
            self.picture_box.Dock = DockStyle.Fill
            self.Controls.Add(self.picture_box)
   photo_form = PhotoForm()
   return(photo_form)
def create_form_with_table(column_names):
    class DynamicForm(Form):
        def __init__(self):
            # Initialize the form
            self.Text = "FAHP User Input Interface"
            self.ClientSize = Size((len(column_names)+1)*150, len(column_names)*28+170)
            
            # Create a label for the whole menu
            self.dropdown_label = Label()
            self.dropdown_label.Text = "Select Importance of Each Criteria :"
            self.dropdown_label.Location = Point(20, 20)
            self.dropdown_label.AutoSize = True
            font = Font(FontFamily.GenericSansSerif,
            8, 2) 
            self.dropdown_label.Font=font
            self.Controls.Add(self.dropdown_label)

            # Create a DataGridView for table input
            self.dataGridView = DataGridView()
            self.dataGridView.Location = Point(20, 40)
            self.dataGridView.Size = Size(len(column_names)*128, len(column_names)*28+20)
            self.dataGridView.AutoGenerateColumns = False
            self.dataGridView.ColumnHeadersDefaultCellStyle.BackColor = Color.LightGreen
            # Define columns based on column_names
            for i, row in enumerate(self.dataGridView.Rows):
                row.HeaderCell.Value = column_names[i]
            column = DataGridViewTextBoxColumn()
               
            for col_name in column_names:
                column = DataGridViewTextBoxColumn()
                column.HeaderText = col_name
                self.dataGridView.Columns.Add(column)
            
            header_style = DataGridViewCellStyle()
            header_style.BackColor = Color.LightGreen
            self.dataGridView.ColumnHeadersDefaultCellStyle = header_style
            self.dataGridView.AllowUserToAddRows = False
            self.Controls.Add(self.dataGridView)
            self.dataGridView.EnableHeadersVisualStyles = False
            self.dataGridView.RowHeadersDefaultCellStyle.BackColor = Color.LightBlue  # Change row headers color
            self.dataGridView.ColumnHeadersDefaultCellStyle.BackColor = Color.LightBlue  # Change column headers color
            self.dataGridView.ColumnHeadersBorderStyle = DataGridViewHeaderBorderStyle.Single
            self.dataGridView.RowHeadersBorderStyle = DataGridViewHeaderBorderStyle.Single
            # Set default values for cells
            global row_values
            for i in range(len(column_names)):
                row_values=["1 1 1" for _ in range(len(column_names))]
                row_values[i]="1 1 1"
                row_values[0:i]=["1 1 1"]*i
                self.dataGridView.Rows.Add(row_values)
            #adjust name of row Headers   
            for i, row in enumerate(self.dataGridView.Rows):
                if i<len(column_names):
                   row.HeaderCell.Value = column_names[i]
                   row.HeaderCell.Width=290
            for i in range(len(self.dataGridView.Rows)):
                for j in range(len(self.dataGridView.Columns)):
                     if j<=i:
                         self.change_cell_color(i, j, Color.LightGray)
                         self.lock_cells(i,j)
            self.dataGridView.RowHeadersWidth = 195
            
            self.dataGridView.CellValueChanged += self.cell_value_changed
            # Set row headers visible and read-only
            self.dataGridView.RowHeadersVisible = True
                   
            # Create a button to submit the input
            self.submit_button = Button()
            self.submit_button.Text = "Submit"
            self.submit_button.Location = Point(len(column_names)*128-50, len(column_names)*28+80)
            self.submit_button.Click += self.submit_button_click
            self.Controls.Add(self.submit_button)
            
            # Create Help buttons
            self.help_button1 = Button()
            self.help_button1.Text = "Factors' Definition"
            self.help_button1.Location = Point(25, len(column_names)*28+80)
            self.help_button1.Size=Size(135,20)
            self.help_button1.Click += self.help_button1_click
            self.Controls.Add(self.help_button1)

            self.help_button2 = Button()
            self.help_button2.Text = "Scoring Assistance"
            self.help_button2.Location = Point(25, len(column_names)*28+100)
            self.help_button2.Size=Size(135,20)
            self.help_button2.Click += self.help_button2_click
            self.Controls.Add(self.help_button2)
            
            #Create Information box
      
            self.info_label = Label()
            self.info_label.Text = "BIM Generated Information"
            self.info_label.Location = Point(25, len(column_names)*28+100+30)
            self.info_label.AutoSize = True
            font = Font(FontFamily.GenericSansSerif,
            8, 2) 
            
            self.info_label.Font=font
            self.Controls.Add(self.info_label)
            
            #Create warning box
            self.warning_label = Label()
            self.warning_label.Text = "No warning"
            self.warning_label.Location = Point(len(column_names)*128+40, 60)
            self.warning_label.Size = Size(300,50)
            font = Font(FontFamily.GenericSansSerif,
            8, 2)
            
            self.warning_label.Font=font
            self.Controls.Add(self.warning_label)
            
            #Create consistency box
            self.consistency_label = Label() 
            self.consistency_label.Text = "Consistency Index:"
            self.consistency_label.Location = Point(len(column_names)*128+40, 130)
            self.consistency_label.Size = Size(300,50)
            font = Font(FontFamily.GenericSansSerif,
            8, 2)
            
            self.consistency_label.Font=font
            self.Controls.Add(self.consistency_label)

            
        def change_cell_color(self, row_index, col_index, color):
             # Change the color of a specific cell
             cell_style = DataGridViewCellStyle()
             cell_style.BackColor = color
             self.dataGridView.Rows[row_index].Cells[col_index].Style = cell_style
        def lock_cells(self, row_index, col_index):
             # Lock a specific cell
             
             
             self.dataGridView.Rows[row_index].Cells[col_index].ReadOnly = True
             
        def cell_value_changed(self, sender, e):
            # Event handler for cell value changed
            row_index = e.RowIndex
            col_index = e.ColumnIndex
            try:
                if col_index > row_index:  # Check if not the last column
                    
                    next_cell = self.dataGridView.Rows[col_index].Cells[row_index]
                    current_value = self.dataGridView.Rows[row_index].Cells[col_index].Value
                    nextvalue=sorted([round(1/float(x),2) for x in str(current_value).split(" ")])
                    next_cell.Value = str(nextvalue[0])+" "+str(nextvalue[1])+" "+str(nextvalue[2]) 
            
                usr_in=[]
                for row in self.dataGridView.Rows:
                    row_avr_values=[]
                    for cell in row.Cells:
                        values=cell.Value.split(" ")
                        for value in values:
                            float(value)
                        cell_avr_value=sum([float(x) for x in (cell.Value.split(" "))])/3
                        
                        row_avr_values.append(cell_avr_value)
                    usr_in.append(row_avr_values)
                
                self.consistency_label.Text = "Consistency Index:"+" "+str(consistency(usr_in) ) 
                if col_index>row_index:
                    self.change_cell_color(row_index, col_index, Color.White)
                    self.warning_label.Text="No warning"
                    self.warning_label.ForeColor=Color.Black
                if consistency(usr_in)>0.1:
                    self.consistency_label.ForeColor=Color.Red
                else:
                    self.consistency_label.ForeColor=Color.Green
            except (ValueError):
                if col_index>row_index:
                    self.change_cell_color(row_index, col_index, Color.Red) 
                    self.warning_label.ForeColor=Color.Red
                    self.warning_label.Text="Invalid Input:\nOnly 3 numbers seprated by a SPACE are accepted."
                
                  
            

        def submit_button_click(self, sender, args):
            # Event handler for submit button click
            global data
            data = [IN[0]]
            # Iterate through rows in DataGridView and retrieve cell values
            for row in self.dataGridView.Rows:
                values = []
                for cell in row.Cells:
                    values.append(cell.Value)
                data.append(values)
            self.Close()
        def help_button1_click(self, sender, args):
            #Event handler for help button 1 click
               
            photo_form = help(r"D:\projects\BIM-Dynamo\MehdiPour\help\D 1.jpg")
            photo_form.Show()
            photo_form.Owner = self
 
        def help_button2_click(self, sender, args):
            # Event handler for button 2
            photo_form = help(r"D:\projects\BIM-Dynamo\MehdiPour\help\D1.jpg")
            photo_form.Show()
            photo_form.Owner = self
            
            


    # Create an instance of the dynamic form
    form = DynamicForm()
    form.ShowDialog()
    
    


# Example usage:
l=1
columnNames=IN[0]
create_form_with_table(IN[0])

# Assign your output to the OUT variable.
OUT = data[0:-1]
# ----------------------------------------
remember = Data.Remember(python_script_7)

# group: Sub Criteria-Ds
remember_2 = Data.Remember(python_script_7)
code_block_5 = CodeBlock(In_D=remember_2) { a=In_D; ["F1","F2"]; ["F3","F4","F5","F6"]; }
python_script_8 = Python(IN[0]=code_block_5.out1, IN[1]=code_block_5.out2, IN[2]=sum)  # CPython3
# ---------- python_script_8.python (292 lines) ----------
# Load the Python Standard and DesignScript Libraries
import sys
import clr
import numpy as np
clr.AddReference('ProtoGeometry')
from Autodesk.DesignScript.Geometry import *

# The inputs to this node will be stored as a list in the IN variables.
dataEnteringNode = IN

# Place your code below this line
from System.Windows.Forms import Form, Button, DataGridView, DataGridViewAutoSizeColumnsMode,  DataGridViewTextBoxColumn,Label,PictureBox,FormStartPosition,PictureBoxSizeMode,DockStyle,DataGridViewCellStyle,DataGridViewHeaderBorderStyle
from System.Drawing import Point, Size, Image, Color,Bitmap,Font,FontFamily

main_criteria_name=["D1-Project Charechteristic","D2-Supply Chain","D3-Time","D4-Cost","D5-Quality","D6-Procurement","D7-Socio Cultural"]
area=IN[2]
def consistency(table):
    error=[]
    random_index={1:0,2:0,3:0.58,4:0.96,5:1.12,6:1.24,7:1.32,8:1.41,9:1.45}
    data=table
    data_orig=table
    data=np.array(data)
    data_orig=np.array(data_orig)
    priority=[1]*len(table)
    differ_priority=np.array([1]*len(table))
    while differ_priority.sum()!=0:
        sum_rows=data.sum(axis=1)
        priority_new=sum_rows/sum_rows.sum()
        differ_priority=np.round(priority_new-priority,9)

        data=data.dot(data)
        priority=priority_new
    overal=data_orig.dot(priority)
    n=len(data[0])
    max_lambda=(overal/priority).sum()/n   
    ci_index=(max_lambda-n)/(n-1)
    con_ratio=ci_index/random_index[n]
    return(round(con_ratio,3))
def help(path):
   class PhotoForm(Form):
        def __init__(self):
            # Initialize the photo form
            self.Text = "Photo Form"
            self.ClientSize = Size(800, 600)
            #self.StartPosition = FormStartPosition.CenterScreen

            # Load the photo
            photo_path = path  # Update with the path to your photo
            photo_image = Image.FromFile(photo_path)

            # Create a picture box to display the photo
            self.picture_box = PictureBox()
            self.picture_box.Image = photo_image
            self.picture_box.SizeMode = PictureBoxSizeMode.Zoom
            self.picture_box.Dock = DockStyle.Fill
            self.Controls.Add(self.picture_box)
   photo_form = PhotoForm()
   return(photo_form)
def create_form_with_table(column_names,mainFactorIndex):
    
    
    class DynamicForm(Form):
        def __init__(self):
            # Initialize the form
            self.Text = "FAHP User Input Interface"
            self.ClientSize = Size((len(column_names)+1)*130+80, len(column_names)*28+240)
            
            # Create a label for the whole menu
            self.dropdown_label = Label()
            print(mainFactorIndex)
            self.dropdown_label.Text = main_criteria_name[mainFactorIndex]
            
            self.dropdown_label.Location = Point(20, 20)
            self.dropdown_label.AutoSize = True
            font = Font(FontFamily.GenericSansSerif,
            8, 1) 
            
            self.dropdown_label.Font=font
            
            self.Controls.Add(self.dropdown_label)

           # Create a DataGridView for table input
            self.dataGridView = DataGridView()
            self.dataGridView.Location = Point(20, 40)
            self.dataGridView.Size = Size(len(column_names)*128, len(column_names)*28+20)
            self.dataGridView.AutoGenerateColumns = False
            self.dataGridView.ColumnHeadersDefaultCellStyle.BackColor = Color.LightGreen
            # Define columns based on column_names
            for i, row in enumerate(self.dataGridView.Rows):
                row.HeaderCell.Value = column_names[i]
            column = DataGridViewTextBoxColumn()
               
            for col_name in column_names:
                column = DataGridViewTextBoxColumn()
                column.HeaderText = col_name
                self.dataGridView.Columns.Add(column)
            
            header_style = DataGridViewCellStyle()
            header_style.BackColor = Color.LightGreen
            self.dataGridView.ColumnHeadersDefaultCellStyle = header_style
            self.dataGridView.AllowUserToAddRows = False
            self.Controls.Add(self.dataGridView)
            self.dataGridView.EnableHeadersVisualStyles = False
            self.dataGridView.RowHeadersDefaultCellStyle.BackColor = Color.LightBlue  # Change row headers color
            self.dataGridView.ColumnHeadersDefaultCellStyle.BackColor = Color.LightBlue  # Change column headers color
            self.dataGridView.ColumnHeadersBorderStyle = DataGridViewHeaderBorderStyle.Single
            self.dataGridView.RowHeadersBorderStyle = DataGridViewHeaderBorderStyle.Single
            # Set default values for cells
            global row_values
            for i in range(len(column_names)):
                row_values=["1 1 1" for _ in range(len(column_names))]
                row_values[i]="1 1 1"
                row_values[0:i]=["1 1 1"]*i
                self.dataGridView.Rows.Add(row_values)
            #adjust name of row Headers   
            for i, row in enumerate(self.dataGridView.Rows):
                if i<len(column_names):
                   row.HeaderCell.Value = column_names[i]
                   row.HeaderCell.Width=290
            for i in range(len(self.dataGridView.Rows)):
                for j in range(len(self.dataGridView.Columns)):
                     if j<=i:
                         self.change_cell_color(i, j, Color.LightGray)
                         self.lock_cells(i,j) 
            self.dataGridView.RowHeadersWidth = 195
            self.dataGridView.CellValueChanged += self.cell_value_changed
            #self.dataGridView.CellValueChanged += self.cell_value_changed
            # Set row headers visible and read-only
            self.dataGridView.RowHeadersVisible = True
            
            # Create a button to submit the input
            self.submit_button = Button()
            self.submit_button.Text = "Submit"
            self.submit_button.Location = Point((len(column_names)+1)*130+80-100, len(column_names)*28+80)
            self.submit_button.Click += self.submit_button_click
            self.Controls.Add(self.submit_button)
            
            # Create Help buttons
            self.help_button1 = Button()
            self.help_button1.Text = "Factors' Definition"
            self.help_button1.Location = Point(25, len(column_names)*28+80)
            self.help_button1.Size=Size(135,20)
            self.help_button1.Click += self.help_button1_click
            self.Controls.Add(self.help_button1)

            self.help_button2 = Button()
            self.help_button2.Text = "Scoring Assistance"
            self.help_button2.Location = Point(25, len(column_names)*28+100)
            self.help_button2.Size=Size(135,20)
            self.help_button2.Click += self.help_button2_click
            self.Controls.Add(self.help_button2)

            #Create Information box
      
            self.biminfo_label = Label()
            self.biminfo_label.Text = " "
            if "F1" in column_names:
                self.biminfo_label.Text = "Offsite construction is advantageous for projects with substantial building size. The total Area of this project is "+str(round(area))+"Sf"
            elif "F11" in column_names:
                self.biminfo_label.Text = "Cost Performance is a critical parameter in off-site construction techniques. The Approximate Cost of this project is: "+str(round(area)*100)+"$"
            self.biminfo_label.Location = Point(25, len(column_names)*28+100+30)
            self.biminfo_label.Size=Size((len(column_names)+1)*115-40,80)
            font = Font(FontFamily.GenericSansSerif,
            8, 2) 
            #Create warning box
            self.warning_label = Label()
            self.warning_label.Text = "No warning"
            self.warning_label.Location = Point(len(column_names)*128+40, 60)
            self.warning_label.Size = Size(300,50)
            font = Font(FontFamily.GenericSansSerif,
            8, 2)
            
            self.warning_label.Font=font
            self.Controls.Add(self.warning_label)
            
            #Create consistency box
            self.consistency_label = Label() 
            self.consistency_label.Text = "Consistency Index:"
            self.consistency_label.Location = Point(len(column_names)*128+40, 130)
            self.consistency_label.Size = Size(300,50)
            font = Font(FontFamily.GenericSansSerif,
            8, 2)
            
            self.consistency_label.Font=font
            self.Controls.Add(self.consistency_label)           
            self.biminfo_label.Font=font
            self.Controls.Add(self.biminfo_label)
            #Create Logo box
            path=r"D:\Nariman Saze\narbiman2.png"
            photo_path = path  
            photo_image = Image.FromFile(photo_path)

            # Create a picture box to display the photo
            self.logo_box = PictureBox()
            self.logo_box.Location = Point((len(column_names)+1)*130+80-100-15, len(column_names)*28+120)
            self.logo_box.Size=Size(100,100)
            self.logo_box.Image = photo_image
            self.logo_box.SizeMode = PictureBoxSizeMode.Zoom
        
            self.Controls.Add(self.logo_box)
            
        def change_cell_color(self, row_index, col_index, color):
             # Change the color of a specific cell
             cell_style = DataGridViewCellStyle()
             cell_style.BackColor = color
             self.dataGridView.Rows[row_index].Cells[col_index].Style = cell_style
        def lock_cells(self, row_index, col_index):
             # Lock a specific cell
             
             
             self.dataGridView.Rows[row_index].Cells[col_index].ReadOnly = True
        def submit_button_click(self, sender, args):
            # Event handler for submit button click
            global data
            data = [column_names]
            # Iterate through rows in DataGridView and retrieve cell values
            for row in self.dataGridView.Rows:
                values = []
                for cell in row.Cells:
                    values.append(cell.Value)
                data.append(values)
            self.Close()
        def help_button1_click(self, sender, args):
            #Event handler for help button 1 click
               
            photo_form = help(r"D:\projects\BIM-Dynamo\MehdiPour\help\D"+str(mainFactorIndex)+".jpg")
            photo_form.Show()
            photo_form.Owner = self

        def help_button2_click(self, sender, args):
            # Event handler for button 2
            photo_form = help(r"D:\projects\BIM-Dynamo\MehdiPour\help\D1.jpg")
            photo_form.Show()
            photo_form.Owner = self
        def cell_value_changed(self, sender, e):
            # Event handler for cell value changed
            row_index = e.RowIndex
            col_index = e.ColumnIndex
            try:
                if col_index > row_index:  # Check if not the last column
                    
                    next_cell = self.dataGridView.Rows[col_index].Cells[row_index]
                    current_value = self.dataGridView.Rows[row_index].Cells[col_index].Value
                    nextvalue=sorted([round(1/float(x),2) for x in str(current_value).split(" ")])
                    next_cell.Value = str(nextvalue[0])+" "+str(nextvalue[1])+" "+str(nextvalue[2]) 
            
                usr_in=[]
                for row in self.dataGridView.Rows:
                    row_avr_values=[]
                    for cell in row.Cells:
                        values=cell.Value.split(" ")
                        for value in values:
                            float(value)
                        cell_avr_value=sum([float(x) for x in (cell.Value.split(" "))])/3
                        
                        row_avr_values.append(cell_avr_value)
                    usr_in.append(row_avr_values)
                 
                self.consistency_label.Text = "Consistency Index:"+" "+str(consistency(usr_in) ) 
                if col_index>row_index:
                    self.change_cell_color(row_index, col_index, Color.White)
                    self.warning_label.Text="No warning"
                    self.warning_label.ForeColor=Color.Black
                if consistency(usr_in)>0.1:
                    self.consistency_label.ForeColor=Color.Red
                else:
                    self.consistency_label.ForeColor=Color.Green
            except (ValueError):
                if col_index>row_index:
                    self.change_cell_color(row_index, col_index, Color.Red) 
                    self.warning_label.ForeColor=Color.Red
                    self.warning_label.Text="Invalid Input:\nOnly 3 numbers seprated by a SPACE are accepted."            


    # Create an instance of the dynamic form
    form = DynamicForm()
    form.ShowDialog()

# Example usage:
subfactors=[[1,2],[3,4,5,6],[7,8,9,10],[11,12,13,14,15],[16,17,18],[19],[20,21]]
inputList=[]
i=0
for main in subfactors:
    column_names=["F"+str(x) for x in main]
    create_form_with_table(column_names,i)
    #data=data[:-1]
    inputList.append(data)
    i=i+1

a=1
# Assign your output to the OUT variable.
OUT = inputList
# ----------------------------------------

remember_3 = Data.Remember(python_script_8)

# group: fs
python_script_9 = Python(IN[0]=python_script_8)  # CPython3; frozen
# ---------- python_script_9.python (165 lines) ----------
# Load the Python Standard and DesignScript Libraries
import sys
import clr
clr.AddReference('ProtoGeometry')
from Autodesk.DesignScript.Geometry import *

# The inputs to this node will be stored as a list in the IN variables.
dataEnteringNode = IN

# Place your code below this line
import clr
clr.AddReference('System.Windows.Forms')
clr.AddReference('System.Drawing')

import pandas as pd
from System.Windows.Forms import Form, Button, DataGridView, DataGridViewAutoSizeColumnsMode, DataGridViewTextBoxColumn,Label,PictureBox,FormStartPosition,PictureBoxSizeMode,DockStyle

from System.Drawing import Point, Size, Image, Bitmap,Font,FontFamily
main_criteria_name=["D1-Project Charechteristic","D2-Supply Chain","D3-Time","D4-Cost","D5-Quality","D6-Procurement","D7-Socio Cultural"]
subCriteria=["F1: Location","F2: Project Design","F3: Financing","F4: Available manufacturer","F5: Available Infrastructure","F6: Experts and skilled workers","F7: Design period","F8: Production time","F9: Mobilization and transfer time","F10: Assembly and construction period","F11: Design","F12: Production and manufacturing","F13: Logistics","F14: Assembly and construction","F15: Maintenance","F16: DfMA + disassembly","F17: Standards and protocols","F18: Sustainability (carbon emission, energy consumption, waste)","F19: Type of procurement and delivery method","F20: Cultural resistance","F21: Local authority regulation (workers’ union syndicate)"]
def create_form_with_table(subFactors,index):
    class DynamicForm(Form):
        def __init__(self):
            # Initialize the form
            column_names=["ALT1","ALT2"]
            self.Text = "FAHP User Input Interface"
            self.ClientSize = Size(400, len(subFactors)*120+170)
            startX=20
            startY=5
            inputData=[]
            # Create a label for the whole menu
            self.dropdown_label = Label()
            self.dropdown_label.Text = "Sub Criteria for  "+main_criteria_name[index]
            self.dropdown_label.Location = Point(startX, startY)
            self.dropdown_label.AutoSize = True
            
            font = Font(FontFamily.GenericSansSerif,
            8, 2) 
            self.dropdown_label.Font=font
            self.Controls.Add(self.dropdown_label)
            for i in range(len(subFactors)):
                # Create a label for the whole menu
                self.dropdown_label = Label()
                self.dropdown_label.Text = subCriteria[subFactors[i]-1]
                self.dropdown_label.Location = Point(startX, startY+30)
                font = Font(FontFamily.GenericSansSerif,
            8, 1) 
            
                self.dropdown_label.Font=font
                self.dropdown_label.AutoSize = True
                self.Controls.Add(self.dropdown_label)

                # Create a DataGridView for table input
                self.dataGridView = DataGridView()
                self.dataGridView.Location = Point(startX, startY+55)
                self.dataGridView.Size = Size(350,70)
                self.dataGridView.AutoGenerateColumns = False
 
                # Define columns based on column_names
                for i, row in enumerate(self.dataGridView.Rows):
                    row.HeaderCell.Value = column_names[i]
                column = DataGridViewTextBoxColumn()
                column.HeaderText = " "
                self.dataGridView.Columns.Add(column)    
                for col_name in column_names:
                    column = DataGridViewTextBoxColumn()
                    column.HeaderText = col_name
                    self.dataGridView.Columns.Add(column)

                self.dataGridView.AutoSizeColumnsMode = DataGridViewAutoSizeColumnsMode.Fill
                self.Controls.Add(self.dataGridView)
                    # Set default values for some cells
                global row_values
                for i in range(len(column_names)):
                   row_values=["" for _ in range(len(column_names))]
                   row_values[i]="1 1 1"
                   row_values[0:i]=["NA"]*i
                   row_values.insert(0, column_names[i])
                   self.dataGridView.Rows.Add(row_values)

                # Set row headers visible and read-only
                self.dataGridView.RowHeadersVisible = True
                startY=startY+120
            
                #for row in self.dataGridView.Rows:
                #   row.HeaderCell.ReadOnly = True
            # Create a button to submit the input
            self.submit_button = Button()
            self.submit_button.Text = "Submit"
            self.submit_button.Location = Point(300, len(subFactors)*115+50)
            self.submit_button.Click += self.submit_button_click
            self.Controls.Add(self.submit_button)
            
            # Create Help buttons
            self.help_button1 = Button()
            self.help_button1.Text = "Factors ' Definition"
            self.help_button1.Location = Point(25, len(subFactors)*115+50)
            self.help_button1.Size=Size(135,20)
            self.help_button1.Click += self.help_button1_click
            self.Controls.Add(self.help_button1)

            self.help_button2 = Button()
            self.help_button2.Text = "Scoring Assistance"
            self.help_button2.Location = Point(25, len(subFactors)*115+70)
            self.help_button2.Size=Size(135,20)
            self.help_button2.Click += self.help_button2_click
            self.Controls.Add(self.help_button2)

            #Create Logo box
            path=r"D:\Nariman Saze\narbiman2.png"
            photo_path = path  
            photo_image = Image.FromFile(photo_path)

            # Create a picture box to display the photo
            self.logo_box = PictureBox()
            self.logo_box.Location = Point(275,len(subFactors)*115+80)
            self.logo_box.Size=Size(100,100)
            self.logo_box.Image = photo_image
            self.logo_box.SizeMode = PictureBoxSizeMode.Zoom
        
            self.Controls.Add(self.logo_box)
 
        def submit_button_click(self, sender, args):
            # Event handler for submit button click
            global data
            data = []
            # Iterate through rows in DataGridView and retrieve cell values
            for control in self.Controls:
                if isinstance(control, DataGridView):
                    gridData=[["","ALT1","ALT2"]]
                    for row in control.Rows:
                        values = []
                        for cell in row.Cells:
                           values.append(cell.Value)
                        gridData.append(values)
                    data.append(gridData[:-1])
            self.Close()
        def help_button1_click(self, sender, args):
            # Event handler for help button 1 click
            #self.picture_box.Image = Image.FromFile(r"C:\Users\narim\Desktop\profile photo.jpg")
            a=1

        def help_button2_click(self, sender, args):
            # Event handler for help button 2 click
            #self.picture_box.Image = Image.FromFile("photo2.jpg")
            a=1

            # Convert the data to a pandas DataFrame
            


    # Create an instance of the dynamic form
    form = DynamicForm()
    form.ShowDialog()

# Example usage:
subFactors=[[1,2],[3,4,5,6],[7,8,9,10],[11,12,13,14,15],[16,17,18],[19],[20,21]]
inputList=[]
for i in range(len(subFactors)):
    create_form_with_table(subFactors[i],i)
    inputList.append(data)


# Assign your output to the OUT variable.
OUT = inputList
# ----------------------------------------
remember_4 = Data.Remember(python_script_9)

python_script_10 = Python(IN[0]=remember, IN[1]=remember_3, IN[2]=remember_4, IN[3]=code_block.alter_names)  # CPython3
# ---------- python_script_10.python (110 lines) ----------
# Load the Python Standard and DesignScript Libraries
import sys
import clr
clr.AddReference('ProtoGeometry')
from Autodesk.DesignScript.Geometry import *

# The inputs to this node will be stored as a list in the IN variables.
dataEnteringNode = IN


# Place your code below this line
import numpy as np
import pandas as pd
from scipy.stats import gmean


alter_names=IN[3]
def fuzzy(parameter,data):
   
   l=len(data)
   geoMean=pd.DataFrame()
   criteria=[]
   for name in data.columns:
       if name[0] not in  criteria:
           criteria.append(name[0])
   for i in list(range(1,l+1)):
      temp=0
      for j in [1,2,3]:
           temp=gmean([data.loc[i-1,(criteria[k],str(j))] for k in range(len(criteria))])
           geoMean.loc[i-1,str(j)]=temp
   a=geoMean.sum(axis=0).transpose()
   geoMean=pd.concat([geoMean,pd.DataFrame(a).transpose()],ignore_index=True)
   geoMean=pd.concat([geoMean,pd.DataFrame(1/geoMean.iloc[-1,:]).transpose()],ignore_index=True)
   geoStat=[min(geoMean.iloc[-1]),geoMean.iloc[-1].mean(),geoMean.iloc[-1].max()]
   fuzzyW=pd.DataFrame()
   for j in range(l):
      temp=[geoMean.iloc[j,i]*geoStat[i] for i in range(3)]
      fuzzyW=pd.concat([fuzzyW,pd.DataFrame(temp).transpose()],ignore_index=True)
   fuzzyW["MI"]=fuzzyW.mean(axis=1)
   fuzzyW["Nor"]=fuzzyW["MI"]/fuzzyW["MI"].sum(axis=0)
   return(fuzzyW)
   
def matrix_prep(inp):
   D_csv=pd.DataFrame(inp)
   columns_D=D_csv.iloc[0][1:]
   
   columns=[]
   for main_column in columns_D:
       for i in [1,2,3]:        
          columns.append((main_column,str(i)))
   D_data=D_csv.iloc[1:]
   D_data=D_data.drop(D_data.columns[0],axis=1)
   k_1=[]
   k_2=[]
   for i in range(len(D_data)):
       new_n=[]
       new_n2=[]
       for n_list in D_data.iloc[i]:

           if n_list[0]==" ":
               n_list=n_list[1:]
           new_n.append([float(x) for x in str(n_list).split(" ") if x!="NA"])
           new_n2.append(sorted([1/float(x) for x in str(n_list).split(" ") if x!="NA"]))
       k_1.append(new_n)
       k_2.append(new_n2)
   for i in range(len(k_1)):
       for j in range(len(k_1[i])):
           if j<i:
               k_1[i][j]=k_2[j][i]
   k_f=[]
   for row in k_1:
       k_f.append([item for sublist in row for item in sublist])
   k_f=pd.DataFrame(k_f)
   k_f.columns=pd.MultiIndex.from_tuples(columns)
   return(k_f)

d_matrixes=[]
fuzzyW_Ds=[]
f_matrixes=[]
fs_fuzzy=[]
for i in range(7):
    d_matrixes.append(matrix_prep(IN[1][i]))
    fuzzyW_Ds.append(fuzzy("f",d_matrixes[i]))
    
subs=[[1,2],[3,4,5,6],[7,8,9,10],[11,12,13,14,15],[16,17,18],[19],[20,21]]
k=0
for i in range(len(subs)):
    temp_f_matrixes=[]
    temp_fs_fuzzy=[]
    for j in range(len(subs[i])): 
        temp_f_matrixes.append(matrix_prep(IN[2][i][j]))
        temp_fs_fuzzy.append(fuzzy("ALT",temp_f_matrixes[j]))
        
        k=k+1
    f_matrixes.append(temp_f_matrixes)
    fs_fuzzy.append(temp_fs_fuzzy)
    
d_matrix=matrix_prep(IN[0])   
fuzzyW_D=fuzzy("D",d_matrix)

final=pd.DataFrame()
for i in range(len(fs_fuzzy)):
    for j in range(len(fs_fuzzy[i])):
       temp=pd.DataFrame([fuzzyW_D["Nor"][i]*fuzzyW_Ds[i]["Nor"][j],fuzzyW_D["Nor"][i]*fuzzyW_Ds[i]["Nor"][j]*fs_fuzzy[i][j]["Nor"][0],fuzzyW_D["Nor"][i]*fuzzyW_Ds[i]["Nor"][j]*fs_fuzzy[i][j]["Nor"][1]]).transpose()
       final=pd.concat([final,temp],ignore_index=True)

rank="1st Alternative ("+alter_names[0]+") Score is " +str(round(final.iloc[:,1].sum(),3))+"\n2nd Alternative ("+alter_names[1]+") Score is " +str(round(final.iloc[:,2].sum(),3))
    
#Assign your output to the OUT variable.
OUT = rank
# ----------------------------------------
python_script_11 = Python(IN[0]=python_script_10)  # CPython3
# ---------- python_script_11.python (24 lines) ----------
# Load the Python Standard and DesignScript Libraries
import sys
import clr
clr.AddReference('ProtoGeometry')
from Autodesk.DesignScript.Geometry import *

# The inputs to this node will be stored as a list in the IN variables.
dataEnteringNode = IN

# Place your code below this line
import clr
clr.AddReference('System.Windows.Forms')
from System.Windows.Forms import MessageBox,MessageBoxButtons, MessageBoxIcon

# Define the custom content as a string
rank = IN[0]
#rank="1st Alternative Score is " +str(round(final.iloc[:,1].sum(),3))+"\n2nd Alternative Score is " +str(round(final.iloc[:,2].sum(),3))
# Define the font for the message box


# Show the MessageBox with custom settings
result = MessageBox.Show(None, rank, "FAHP Ranking Results", MessageBoxButtons.OK, MessageBoxIcon.Information)
# Assign your output to the OUT variable.
OUT = 0
# ----------------------------------------
python_script_12 = Python(IN[0]=python_script_10)  # CPython3; frozen
# ---------- python_script_12.python (51 lines) ----------
# Load the Python Standard and DesignScript Libraries
import clr
clr.AddReference('System.Windows.Forms')
clr.AddReference('System.Drawing')
clr.AddReference('ProtoGeometry')
from Autodesk.DesignScript.Geometry import *

# The inputs to this node will be stored as a list in the IN variables.
dataEnteringNode = IN
from System.Windows.Forms import Form, Label, Button, TextBox, TreeView, TreeNode
from System.Drawing import Point, Size

# Define a global variable to store the selected items
selected_items = []

class MyForm(Form):
    def __init__(self):
        # Initialize the form
        self.Text = "User Input Form"
        self.ClientSize = Size(350, 400)

        # Create a label for the text input
        self.text_label = Label()
        self.text_label.Text = IN[0]
        self.text_label.Location = Point(20, 20)
        self.text_label.AutoSize = True
        self.Controls.Add(self.text_label)


        # Create a button to submit the input
        self.submit_button = Button()
        self.submit_button.Text = "Calculate"
        self.submit_button.Location = Point(20, 320)
        self.submit_button.Click += self.submit_button_click
        self.Controls.Add(self.submit_button)

    def submit_button_click(self, sender, args):
        # Event handler for submit button click

        self.Close()

        

# Create an instance of the form
form = MyForm()
form.ShowDialog()


#return (Autodesk.Revit.UI.Result.Succeeded)
# Assign your output to the OUT variable.
OUT =0
# ----------------------------------------
python_script_13 = Python(IN[0]=python_script_3)  # CPython3
# ---------- python_script_13.python (39 lines) ----------
# Load the Python Standard and DesignScript Libraries

import clr
clr.AddReference('RevitAPI')
from Autodesk.Revit.DB import *
from Autodesk.Revit.UI import TaskDialog, UIApplication, UIDocument, PostableCommand

clr.AddReference('RevitServices')
import RevitServices
from RevitServices.Persistence import DocumentManager

clr.AddReference('System.Drawing')
from System.Drawing import Size, Point

clr.AddReference('System.Windows.Forms')
from System.Windows.Forms import Application, Button, Form, Label, TextBox

doc = DocumentManager.Instance.CurrentDBDocument
uiapp = DocumentManager.Instance.CurrentUIApplication
app = uiapp.Application
family=IN[0][0][0]
def open_family_type_properties_dialog(family_type):
    """
    Opens the Type Properties panel for the given FamilySymbol (family type).
    
    Args:
        family_type (FamilySymbol): The FamilySymbol (family type) for which to open the Type Properties panel.
    """
    try:
        uiapp = __revit__.UIApplication
        uiapp.PostCommand(PostableCommand.FamilyTypes)
    except Exception as ex:
        print("Error:", ex)

a=open_family_type_properties_dialog(family)
# Assign your output to the OUT variable.

# Assign your output to the OUT variable.
OUT = 11221
# ----------------------------------------
