# Dynamo graph TableInput.dyn (Dynamo 2.18.1.5096)
# packages: Data-Shapes 2023.2.112, GenerativeDesign 6.0.2.0, Clockwork for Dynamo 2.x 2.3.0

categories = Categories("OST_Floors")
all_family_types_of_category = Custom[All Family Types Of Category](category=categories@L1)  # package Clockwork for Dynamo 2.x; Gets all family types/symbols of a given category in the model.
flatten = List.Flatten(list=all_family_types_of_category)
python_script = Python(IN[0]=flatten)  # CPython3
# ---------- python_script.python (99 lines) ----------
# Load the Python Standard and DesignScript Libraries
import sys
import clr
clr.AddReference('ProtoGeometry')
clr.AddReference('System.Windows.Forms')
clr.AddReference('System.Drawing')
from Autodesk.DesignScript.Geometry import *
from System.Windows.Forms import Form, Label, Button, TextBox, ComboBox, TreeNode, TreeView
from System.Drawing import Point, Size
# The inputs to this node will be stored as a list in the IN variables.
dataEnteringNode = IN

# Place your code below this line
familyList=IN[0]
familyName=[str(x) for x in familyList]
familyDict=dict(zip(familyName,familyList))

class MyForm(Form):
    def __init__(self):
        # Initialize the form
        self.Text = "User Input Form"
        self.ClientSize = Size(350, 400)

        # Create a label for the text input
        self.label = Label()
        self.label.Text = "Enter Project ZipCode:"
        self.label.Location = Point(20, 20)
        self.label.AutoSize = True
        self.Controls.Add(self.label)

        # Create a textbox for the user input
        self.textbox = TextBox()
        self.textbox.Location = Point(20, 40)
        self.textbox.Size = Size(200, 20)
        self.Controls.Add(self.textbox)

        # Create a label for the dropdown
        #self.dropdown_label = Label()
        #self.dropdown_label.Text = "Select an option:"
        #self.dropdown_label.Location = Point(20, 80)
        #self.dropdown_label.AutoSize = True
        #self.Controls.Add(self.dropdown_label)

        # Create a dropdown (combobox) for the user input
        #self.dropdown = ComboBox()
        #self.dropdown.Location = Point(20, 110)
        #self.dropdown.Size = Size(200, 20)
        #self.dropdown.Items.AddRange(["Option 1", "Option 2", "Option 3"])  # Predefined options
        #self.Controls.Add(self.dropdown)

        # Create a label for the treeview
        self.tree_label = Label()
        self.tree_label.Text = "Select Main Floor Families:"
        self.tree_label.Location = Point(20, 80)
        self.tree_label.AutoSize = True
        self.Controls.Add(self.tree_label)

        # Create a treeview for the user input
        self.treeview = TreeView()
        self.treeview.Location = Point(20, 100)
        self.treeview.Size = Size(300, 200)
        self.treeview.CheckBoxes = True  # Enable checkboxes for multiple selections
        for family in familyName:
           self.treeview.Nodes.Add(family)  # Add a root node
        
        self.Controls.Add(self.treeview)

        # Create a button to submit the input
        self.submit_button = Button()
        self.submit_button.Text = "Submit"
        self.submit_button.Location = Point(20, 320)
        self.submit_button.Click += self.submit_button_click
        self.Controls.Add(self.submit_button)

    def submit_button_click(self, sender, args):
        # Event handler for submit button click
        global selected_items,zipCode
        selected_items=[]
        # Clear the list before adding new items
        selected_items.clear()
        # Get selected nodes from the treeview recursively
        self.get_selected_nodes(self.treeview.Nodes)
        zipCode = self.textbox.Text
        self.Close()
    def get_selected_nodes(self, nodes):
        # Recursively iterate through all nodes and their children
        for node in nodes:
            if node.Checked:
                selected_items.append(familyDict[node.Text])
            self.get_selected_nodes(node.Nodes)


# Create an instance of the form
form = MyForm()
form.ShowDialog()


# Assign your output to the OUT variable.
OUT = selected_items,zipCode
# ----------------------------------------
watch = Watch(python_script)
code_block = CodeBlock(userIN=watch) { userIN; families=userIN[0]; zipCode=userIN[1]; }
flatten_2 = List.Flatten(list=code_block.families)
all_elements_of_family_type = Custom[All Elements of Family Type+](familyType=flatten_2)  # package Clockwork for Dynamo 2.x; Unlike the built-in node, this node retrieves all placed instances of a given loadable *or* system family type
code_block_2 = CodeBlock { "Area"; }
getParameterValueByName = Element.GetParameterValueByName(element=all_elements_of_family_type, parameterName=code_block_2)
flatten_3 = List.Flatten(list=getParameterValueByName)
sum = Math.Sum(values=flatten_3)
code_block_3 = CodeBlock(area=sum)
# ---------- code_block_3.designscript (2 lines) ----------
["D1-Project Charechteristic","D2-Supply Chain","D3-Time","D4-Cost","D5-Quality","D6-Procurement","D7-Socio Cultural"];
area;
# ----------------------------------------
python_script_2 = Python(IN[0]=code_block_3.out0)  # CPython3
# ---------- python_script_2.python (131 lines) ----------
# Load the Python Standard and DesignScript Libraries
import sys
import clr
clr.AddReference('ProtoGeometry')
from Autodesk.DesignScript.Geometry import *

# The inputs to this node will be stored as a list in the IN variables.
dataEnteringNode = IN

# Place your code below this line
import clr
clr.AddReference('System.Windows.Forms')
clr.AddReference('System.Drawing')

import pandas as pd
from System.Windows.Forms import Form, Button, DataGridView, DataGridViewAutoSizeColumnsMode, DataGridViewTextBoxColumn,Label,PictureBox
from System.Drawing import Point, Size, Image, Bitmap

def create_form_with_table(column_names):
    class DynamicForm(Form):
        def __init__(self):
            # Initialize the form
            self.Text = "Dynamic Table Input Form"
            self.ClientSize = Size((len(column_names)+1)*150, len(column_names)*28+170)
            
            # Create a label for the whole menu
            self.dropdown_label = Label()
            self.dropdown_label.Text = "Select Importance of Each Criteria :"
            self.dropdown_label.Location = Point(20, 20)
            self.dropdown_label.AutoSize = True
            self.Controls.Add(self.dropdown_label)

            # Create a DataGridView for table input
            self.dataGridView = DataGridView()
            self.dataGridView.Location = Point(20, 40)
            self.dataGridView.Size = Size((len(column_names)+1)*140, len(column_names)*28+20)
            self.dataGridView.AutoGenerateColumns = False

            # Define columns based on column_names
            for i, row in enumerate(self.dataGridView.Rows):
                row.HeaderCell.Value = column_names[i]
            column = DataGridViewTextBoxColumn()
            column.HeaderText = " "
            self.dataGridView.Columns.Add(column)    
            for col_name in column_names:
                column = DataGridViewTextBoxColumn()
                column.HeaderText = col_name
                self.dataGridView.Columns.Add(column)

            self.dataGridView.AutoSizeColumnsMode = DataGridViewAutoSizeColumnsMode.Fill
            self.Controls.Add(self.dataGridView)
                    # Set default values for some cells
            global row_values
            for i in range(len(column_names)):
                row_values=["" for _ in range(len(column_names))]
                row_values[i]="1 1 1"
                row_values[0:i]=["NA"]*i
                row_values.insert(0, column_names[i])
                self.dataGridView.Rows.Add(row_values)

            # Set row headers visible and read-only
            self.dataGridView.RowHeadersVisible = True
            
            #for row in self.dataGridView.Rows:
             #   row.HeaderCell.ReadOnly = True
            # Create a button to submit the input
            self.submit_button = Button()
            self.submit_button.Text = "Submit"
            self.submit_button.Location = Point((len(column_names)+1)*130, len(column_names)*28+80)
            self.submit_button.Click += self.submit_button_click
            self.Controls.Add(self.submit_button)
            
            # Create Help buttons
            self.help_button1 = Button()
            self.help_button1.Text = "Factors' Definition"
            self.help_button1.Location = Point(25, len(column_names)*28+80)
            self.help_button1.Size=Size(135,20)
            self.help_button1.Click += self.help_button1_click
            self.Controls.Add(self.help_button1)

            self.help_button2 = Button()
            self.help_button2.Text = "Scoring Assistance"
            self.help_button2.Location = Point(25, len(column_names)*28+100)
            self.help_button2.Size=Size(135,20)
            self.help_button2.Click += self.help_button2_click
            self.Controls.Add(self.help_button2)

            # PictureBox for displaying photo
            self.picture_box = PictureBox()
            self.picture_box.Location = Point(20, 260)
            self.picture_box.Size = Size(500, 100)
            self.Controls.Add(self.picture_box)

            # Load initial photo
            #self.picture_box.Image = Image.FromFile("photo1.jpg")

        def submit_button_click(self, sender, args):
            # Event handler for submit button click
            global data
            data = []
            # Iterate through rows in DataGridView and retrieve cell values
            for row in self.dataGridView.Rows:
                values = []
                for cell in row.Cells:
                    values.append(cell.Value)
                data.append(values)
            self.Close()
        def help_button1_click(self, sender, args):
            # Event handler for help button 1 click
            #self.picture_box.Image = Image.FromFile(r"C:\Users\narim\Desktop\profile photo.jpg")
            a=1

        def help_button2_click(self, sender, args):
            # Event handler for help button 2 click
            #self.picture_box.Image = Image.FromFile("photo2.jpg")
            a=1

            # Convert the data to a pandas DataFrame
            


    # Create an instance of the dynamic form
    form = DynamicForm()
    form.ShowDialog()

# Example usage:
columnNames=IN[0]
create_form_with_table(IN[0])

# Assign your output to the OUT variable.
OUT = data
# ----------------------------------------
remember = Data.Remember(python_script_2)
code_block_4 = CodeBlock { 1; }
flatten_4 = List.Flatten(list=remember, amount=code_block_4)  # frozen
code_block_5 = CodeBlock { "Wieght the importance of each Criteria with respect to others"; }
code_block_6 = CodeBlock(area=sum)  # frozen
# ---------- code_block_6.designscript (4 lines) ----------
"Main Criteria Importances";
data=[[" ","  ","   ","    ","     ","      ","       ","        "],[" ","D1-Project Charechteristic","D2-Supply Chain","D3-Time","D4-Cost","D5-Quality","D6-Procurement","D7-Socio Cultural"],["D1-Project Charechteristic","1 1 1","","","","","",""],["D2-Supply Chain","","1 1 1","","","","",""],["D3-Time","","","1 1 1","","","",""],["D4-Cost","","","","1 1 1","","",""],["D5-Quality","","","","","1 1 1","",""],["D6-Procurement","","","","","","1 1 1",""],["D7-Socio Cultural","","","","","","","1 1 1"]];
true;
area;
# ----------------------------------------
datatable_input = Custom[DataTable input](InputName=code_block_6.out0, Data=code_block_6.data, FirstRowIsTitles=code_block_6.out2)  # package Data-Shapes; Create a DataTable view input for UI.MultipleInputForm ++
list_create = List.Create(item0=datatable_input)
boolean = BoolSelector(true)
file_path = Filename("C:\Users\narim\Desktop\concordia.png")
code_block_7 = CodeBlock { 1100; 970; }
multipleinputform = Custom[MultipleInputForm ++](Description_optional=code_block_5, Inputs=list_create, Toggle=boolean, LinkToHelp_optional=file_path, MaxHeight_optional=code_block_7.out0, Width_optional=code_block_7.out1)  # package Data-Shapes; Create a form with multiple inputs. see www.data-shapes.net for tutorials and infos!
watch_2 = Watch(multipleinputform.User_Inputs)
code_block_8 = CodeBlock {  }
code_block_9 = CodeBlock(in_D=remember) { a=in_D; data=[[" ","  ","   "],[" ","  f1","  f2"],["f1","1 1 1",""],["f2","NA","1 1 1"]]; true; }
code_block_10 = CodeBlock { "Sub-Criteria Importances"; }
code_block_11 = CodeBlock { "D1: Project Charechteristics"; }
datatable_input_2 = Custom[DataTable input](InputName=code_block_11, Data=code_block_9.data, FirstRowIsTitles=code_block_9.out2)
code_block_12 = CodeBlock { "D2: Supply Chain"; }
code_block_13 = CodeBlock()
# ---------- code_block_13.designscript (2 lines) ----------
data=[[" ","  ","   ","    ","     "],[" ","f3","f4","f5","f6"],["f3","1 1 1","","",""],["f4","NA","1 1 1","",""],["f5","NA","NA","1 1 1",""],["f6","NA","NA","NA","1 1 1"]];
true;
# ----------------------------------------
datatable_input_3 = Custom[DataTable input](InputName=code_block_12, Data=code_block_13.data, FirstRowIsTitles=code_block_13.out1)
list_create_2 = List.Create(item0=datatable_input_2, item1=datatable_input_3)
boolean_2 = BoolSelector(false)
file_path_2 = Filename("help\D1.pdf")
code_block_14 = CodeBlock { 100; }
multipleinputform_2 = Custom[MultipleInputForm ++](Description_optional=code_block_10, Inputs=list_create_2, Toggle=boolean_2, LinkToHelp_optional=file_path_2, Width_optional=code_block_14, LabelWidth_optional=code_block_14)
watch_3 = Watch(multipleinputform_2.User_Inputs)
remember_2 = Data.Remember(watch_3)
code_block_15 = CodeBlock(a=remember_2) { in_D1=a[0]; in_D2=a[1]; }
code_block_16 = CodeBlock(in_2=remember_2)
# ---------- code_block_16.designscript (3 lines) ----------
in_2;
data=[[" ","  ","   ","    ","     "],[" ","f7","f8","f9","f10"],["f7","1 1 1","","",""],["f8","","1 1 1","",""],["f9","","","1 1 1",""],["f10","","","","1 1 1"]];
true;
# ----------------------------------------
datatable_input_4 = Custom[DataTable input](Data=code_block_16.data, FirstRowIsTitles=code_block_16.out2)
code_block_17 = CodeBlock()
# ---------- code_block_17.designscript (2 lines) ----------
data=[[" ","  ","   ","    ","     ","      "],[" ","f11","f12","f13","f14","f15"],["f11","1 1 1","","","",""],["f12","","1 1 1","","",""],["f13","","","1 1 1","",""],["f14","","","","1 1 1",""],["f15","","","","","1 1 1"]];
true;
# ----------------------------------------
datatable_input_5 = Custom[DataTable input](Data=code_block_17.data, FirstRowIsTitles=code_block_17.out1)
list_create_3 = List.Create(item0=datatable_input_4, item1=datatable_input_5)
boolean_3 = BoolSelector(false)
file_path_3 = Filename("C:\Users\narim\Desktop\concordia.png")
multipleinputform_3 = Custom[MultipleInputForm ++](Inputs=list_create_3, Toggle=boolean_3, LinkToHelp_optional=file_path_3)
watch_4 = Watch(multipleinputform_3.User_Inputs)
remember_3 = Data.Remember(watch_4)
code_block_18 = CodeBlock(a=remember_3) { in_D3=a[0]; in_D4=a[1]; }
code_block_19 = CodeBlock(in_2=remember_3)
# ---------- code_block_19.designscript (3 lines) ----------
in_2;
data=[[" ","  ","   ","    "],[" ","f16","f17","f18"],["f16","1 1 1","",""],["f17","","1 1 1",""],["f18","","","1 1 1"]];
true;
# ----------------------------------------
datatable_input_6 = Custom[DataTable input](Data=code_block_19.data, FirstRowIsTitles=code_block_19.out2)
code_block_20 = CodeBlock { data=[[" ","  ","   "],[" ","f20","f21"],["f20","1 1 1",""],["f21","","1 1 1"]]; true; }
datatable_input_7 = Custom[DataTable input](Data=code_block_20.data, FirstRowIsTitles=code_block_20.out1)
list_create_4 = List.Create(item0=datatable_input_6, item1=datatable_input_7)
boolean_4 = BoolSelector(false)
file_path_4 = Filename("C:\Users\narim\Desktop\concordia.png")
multipleinputform_4 = Custom[MultipleInputForm ++](Inputs=list_create_4, Toggle=boolean_4, LinkToHelp_optional=file_path_4)
watch_5 = Watch(multipleinputform_4.User_Inputs)
remember_4 = Data.Remember(watch_5)

# group: last input for Ds
code_block_21 = CodeBlock(a=remember_4) { in_D5=a[0]; in_D6=[[" "," "],["","f19"],["f19","1 1 1"]]; in_D7=a[1]; }

code_block_22 = CodeBlock(in_D=code_block_9.a, in_D1=code_block_15.in_D1, in_D2=code_block_15.in_D2, in_D3=code_block_18.in_D3, in_D4=code_block_18.in_D4, in_D5=code_block_21.in_D5, in_D6=code_block_21.in_D6, in_D7=code_block_21.in_D7) { in_D; in_D1; in_D2; in_D3; in_D4; in_D5; in_D6; in_D7; }
code_block_23 = CodeBlock(in_2=code_block_21.in_D5) { in_2; "f1"; data=[[" ","  ","   "],[" ","ALT1","ALT2"],["ALT1","1 1 1",""],["ALT2","","1 1 1"]]; true; }
datatable_input_8 = Custom[DataTable input](InputName=code_block_23.out1, Data=code_block_23.data, FirstRowIsTitles=code_block_23.out3)
code_block_24 = CodeBlock { "f2"; data=[[" ","  ","   "],[" ","ALT1","ALT2"],["ALT1","1 1 1",""],["ALT2","","1 1 1"]]; true; }
datatable_input_9 = Custom[DataTable input](InputName=code_block_24.out0, Data=code_block_24.data, FirstRowIsTitles=code_block_24.out2)
code_block_25 = CodeBlock { "f3"; data=[[" ","  ","   "],[" ","ALT1","ALT2"],["ALT1","1 1 1",""],["ALT2","","1 1 1"]]; true; }
datatable_input_10 = Custom[DataTable input](InputName=code_block_25.out0, Data=code_block_25.data, FirstRowIsTitles=code_block_25.out2)
code_block_26 = CodeBlock { "f4"; data=[[" ","  ","   "],[" ","ALT1","ALT2"],["ALT1","1 1 1",""],["ALT2","","1 1 1"]]; true; }
datatable_input_11 = Custom[DataTable input](InputName=code_block_26.out0, Data=code_block_26.data, FirstRowIsTitles=code_block_26.out2)
list_create_5 = List.Create(item0=datatable_input_8, item1=datatable_input_9, item2=datatable_input_10, item3=datatable_input_11)
boolean_5 = BoolSelector(true)
file_path_5 = Filename("C:\Users\narim\Desktop\concordia.png")
multipleinputform_5 = Custom[MultipleInputForm ++](Inputs=list_create_5, Toggle=boolean_5, LinkToHelp_optional=file_path_5)
watch_6 = Watch(multipleinputform_5.User_Inputs)
remember_5 = Data.Remember(watch_6)
code_block_27 = CodeBlock(a=remember_5) { in_f1=a[0]; in_f2=a[1]; in_f3=a[2]; in_f4=a[3]; }
code_block_28 = CodeBlock(in_f1234=remember_5) { in_f1234; "f5"; data=[[" ","  ","   "],[" ","ALT1","ALT2"],["ALT1","1 1 1",""],["ALT2","","1 1 1"]]; true; }
datatable_input_12 = Custom[DataTable input](InputName=code_block_28.out1, Data=code_block_28.data, FirstRowIsTitles=code_block_28.out3)
code_block_29 = CodeBlock { "f6"; data=[[" ","  ","   "],[" ","ALT1","ALT2"],["ALT1","1 1 1",""],["ALT2","","1 1 1"]]; true; }
datatable_input_13 = Custom[DataTable input](InputName=code_block_29.out0, Data=code_block_29.data, FirstRowIsTitles=code_block_29.out2)
code_block_30 = CodeBlock { "f7"; data=[[" ","  ","   "],[" ","ALT1","ALT2"],["ALT1","1 1 1",""],["ALT2","","1 1 1"]]; true; }
datatable_input_14 = Custom[DataTable input](InputName=code_block_30.out0, Data=code_block_30.data, FirstRowIsTitles=code_block_30.out2)
code_block_31 = CodeBlock { "f8"; data=[[" ","  ","   "],[" ","ALT1","ALT2"],["ALT1","1 1 1",""],["ALT2","","1 1 1"]]; true; }
datatable_input_15 = Custom[DataTable input](InputName=code_block_31.out0, Data=code_block_31.data, FirstRowIsTitles=code_block_31.out2)
list_create_6 = List.Create(item0=datatable_input_12, item1=datatable_input_13, item2=datatable_input_14, item3=datatable_input_15)
boolean_6 = BoolSelector(true)
file_path_6 = Filename("C:\Users\narim\Desktop\concordia.png")
multipleinputform_6 = Custom[MultipleInputForm ++](Inputs=list_create_6, Toggle=boolean_6, LinkToHelp_optional=file_path_6)
watch_7 = Watch(multipleinputform_6.User_Inputs)
remember_6 = Data.Remember(watch_7)
code_block_32 = CodeBlock(a=remember_6) { in_f5=a[0]; in_f6=a[1]; in_f7=a[2]; in_f8=a[3]; }
code_block_33 = CodeBlock(in_f5678=remember_6) { in_f5678; "f9"; data=[[" ","  ","   "],[" ","ALT1","ALT2"],["ALT1","1 1 1",""],["ALT2","","1 1 1"]]; true; }
datatable_input_16 = Custom[DataTable input](InputName=code_block_33.out1, Data=code_block_33.data, FirstRowIsTitles=code_block_33.out3)
code_block_34 = CodeBlock { "f10"; data=[[" ","  ","   "],[" ","ALT1","ALT2"],["ALT1","1 1 1",""],["ALT2","","1 1 1"]]; true; }
datatable_input_17 = Custom[DataTable input](InputName=code_block_34.out0, Data=code_block_34.data, FirstRowIsTitles=code_block_34.out2)
code_block_35 = CodeBlock { "f11"; data=[[" ","  ","   "],[" ","ALT1","ALT2"],["ALT1","1 1 1",""],["ALT2","","1 1 1"]]; true; }
datatable_input_18 = Custom[DataTable input](InputName=code_block_35.out0, Data=code_block_35.data, FirstRowIsTitles=code_block_35.out2)
code_block_36 = CodeBlock { "f12"; data=[[" ","  ","   "],[" ","ALT1","ALT2"],["ALT1","1 1 1",""],["ALT2","","1 1 1"]]; true; }
datatable_input_19 = Custom[DataTable input](InputName=code_block_36.out0, Data=code_block_36.data, FirstRowIsTitles=code_block_36.out2)
list_create_7 = List.Create(item0=datatable_input_16, item1=datatable_input_17, item2=datatable_input_18, item3=datatable_input_19)
boolean_7 = BoolSelector(true)
file_path_7 = Filename("C:\Users\narim\Desktop\concordia.png")
multipleinputform_7 = Custom[MultipleInputForm ++](Inputs=list_create_7, Toggle=boolean_7, LinkToHelp_optional=file_path_7)
watch_8 = Watch(multipleinputform_7.User_Inputs)
remember_7 = Data.Remember(watch_8)
code_block_37 = CodeBlock(a=remember_7) { in_f9=a[0]; in_f10=a[1]; in_f11=a[2]; in_f12=a[3]; }
code_block_38 = CodeBlock(in_f9101112=remember_7) { in_f9101112; "f13"; data=[[" ","  ","   "],[" ","ALT1","ALT2"],["ALT1","1 1 1",""],["ALT2","","1 1 1"]]; true; }
datatable_input_20 = Custom[DataTable input](InputName=code_block_38.out1, Data=code_block_38.data, FirstRowIsTitles=code_block_38.out3)
code_block_39 = CodeBlock { "f14"; data=[[" ","  ","   "],[" ","ALT1","ALT2"],["ALT1","1 1 1",""],["ALT2","","1 1 1"]]; true; }
datatable_input_21 = Custom[DataTable input](InputName=code_block_39.out0, Data=code_block_39.data, FirstRowIsTitles=code_block_39.out2)
code_block_40 = CodeBlock { "f15"; data=[[" ","  ","   "],[" ","ALT1","ALT2"],["ALT1","1 1 1",""],["ALT2","","1 1 1"]]; true; }
datatable_input_22 = Custom[DataTable input](InputName=code_block_40.out0, Data=code_block_40.data, FirstRowIsTitles=code_block_40.out2)
code_block_41 = CodeBlock { "f4"; data=[[" ","  ","   "],[" ","ALT1","ALT2"],["ALT1","1 1 1",""],["ALT2","","1 1 1"]]; true; }
datatable_input_23 = Custom[DataTable input](InputName=code_block_41.out0, Data=code_block_41.data, FirstRowIsTitles=code_block_41.out2)
list_create_8 = List.Create(item0=datatable_input_20, item1=datatable_input_21, item2=datatable_input_22, item3=datatable_input_23)
boolean_8 = BoolSelector(true)
file_path_8 = Filename("C:\Users\narim\Desktop\concordia.png")
multipleinputform_8 = Custom[MultipleInputForm ++](Inputs=list_create_8, Toggle=boolean_8, LinkToHelp_optional=file_path_8)
watch_9 = Watch(multipleinputform_8.User_Inputs)
remember_8 = Data.Remember(watch_9)
code_block_42 = CodeBlock(a=remember_8) { in_f13=a[0]; in_f14=a[1]; in_f15=a[2]; in_f16=a[3]; }
code_block_43 = CodeBlock(in_f13141516=remember_8) { in_f13141516; "f17"; data=[[" ","  ","   "],[" ","ALT1","ALT2"],["ALT1","1 1 1",""],["ALT2","","1 1 1"]]; true; }
datatable_input_24 = Custom[DataTable input](InputName=code_block_43.out1, Data=code_block_43.data, FirstRowIsTitles=code_block_43.out3)
code_block_44 = CodeBlock { "f18"; data=[[" ","  ","   "],[" ","ALT1","ALT2"],["ALT1","1 1 1",""],["ALT2","","1 1 1"]]; true; }
datatable_input_25 = Custom[DataTable input](InputName=code_block_44.out0, Data=code_block_44.data, FirstRowIsTitles=code_block_44.out2)
code_block_45 = CodeBlock { "f19"; data=[[" ","  ","   "],[" ","ALT1","ALT2"],["ALT1","1 1 1",""],["ALT2","","1 1 1"]]; true; }
datatable_input_26 = Custom[DataTable input](InputName=code_block_45.out0, Data=code_block_45.data, FirstRowIsTitles=code_block_45.out2)
code_block_46 = CodeBlock { "f20"; data=[[" ","  ","   "],[" ","ALT1","ALT2"],["ALT1","1 1 1",""],["ALT2","","1 1 1"]]; true; }
datatable_input_27 = Custom[DataTable input](InputName=code_block_46.out0, Data=code_block_46.data, FirstRowIsTitles=code_block_46.out2)
list_create_9 = List.Create(item0=datatable_input_24, item1=datatable_input_25, item2=datatable_input_26, item3=datatable_input_27)
boolean_9 = BoolSelector(true)
file_path_9 = Filename("C:\Users\narim\Desktop\concordia.png")
multipleinputform_9 = Custom[MultipleInputForm ++](Inputs=list_create_9, Toggle=boolean_9, LinkToHelp_optional=file_path_9)
watch_10 = Watch(multipleinputform_9.User_Inputs)
remember_9 = Data.Remember(watch_10)
code_block_47 = CodeBlock(a=remember_9) { in_f17=a[0]; in_f18=a[1]; in_f19=a[2]; in_f20=a[3]; }
code_block_48 = CodeBlock(in_17181920=remember_9) { in_17181920; "f21"; data=[[" ","  ","   "],[" ","ALT1","ALT2"],["ALT1","1 1 1",""],["ALT2","","1 1 1"]]; true; }
datatable_input_28 = Custom[DataTable input](InputName=code_block_48.out1, Data=code_block_48.data, FirstRowIsTitles=code_block_48.out3)
list_create_10 = List.Create(item0=datatable_input_28)
boolean_10 = BoolSelector(true)
file_path_10 = Filename("C:\Users\narim\Desktop\concordia.png")
multipleinputform_10 = Custom[MultipleInputForm ++](Inputs=list_create_10, Toggle=boolean_10, LinkToHelp_optional=file_path_10)
watch_11 = Watch(multipleinputform_10.User_Inputs)
remember_10 = Data.Remember(watch_11)
code_block_49 = CodeBlock(a=remember_10) { in_f21=a[0]; }
code_block_50 = CodeBlock(in_f1=code_block_27.in_f1, in_f2=code_block_27.in_f2, in_f3=code_block_27.in_f3, in_f4=code_block_27.in_f4, in_f5=code_block_32.in_f5, in_f6=code_block_32.in_f6, in_f7=code_block_32.in_f7, in_f8=code_block_32.in_f8, in_f9=code_block_37.in_f9, in_f10=code_block_37.in_f10, in_f11=code_block_37.in_f11, in_f12=code_block_37.in_f12, in_f13=code_block_42.in_f13, in_f14=code_block_42.in_f14, in_f15=code_block_42.in_f15, in_f16=code_block_42.in_f16, in_f17=code_block_47.in_f17, in_f18=code_block_47.in_f18, in_f19=code_block_47.in_f19, in_f20=code_block_47.in_f20, in_f21=code_block_49)
# ---------- code_block_50.designscript (21 lines) ----------
in_f1;
in_f2;
in_f3;
in_f4;
in_f5;
in_f6;
in_f7;
in_f8;
in_f9;
in_f10;
in_f11;
in_f12;
in_f13;
in_f14;
in_f15;
in_f16;
in_f17;
in_f18;
in_f19;
in_f20;
in_f21;
# ----------------------------------------
python_script_3 = Python(IN[0]=code_block_22.in_D, IN[1]=code_block_22.in_D1, IN[2]=code_block_22.in_D2, IN[3]=code_block_22.in_D3, IN[4]=code_block_22.in_D4, IN[5]=code_block_22.in_D5, IN[6]=code_block_22.in_D6, IN[7]=code_block_22.in_D7, IN[8]=code_block_50.in_f1, IN[9]=code_block_50.in_f2, IN[10]=code_block_50.in_f3, IN[11]=code_block_50.in_f4, IN[12]=code_block_50.in_f5, IN[13]=code_block_50.in_f6, IN[14]=code_block_50.in_f7, IN[15]=code_block_50.in_f8, IN[16]=code_block_50.in_f9, IN[17]=code_block_50.in_f10, IN[18]=code_block_50.in_f11, IN[19]=code_block_50.in_f12, IN[20]=code_block_50.in_f13, IN[21]=code_block_50.in_f14, IN[22]=code_block_50.in_f15, IN[23]=code_block_50.in_f16, IN[24]=code_block_50.in_f17, IN[25]=code_block_50.in_f18, IN[26]=code_block_50.in_f19, IN[27]=code_block_50.in_f20, IN[28]=code_block_50.in_f21)  # CPython3
# ---------- python_script_3.python (103 lines) ----------
# Load the Python Standard and DesignScript Libraries
import sys
import clr
clr.AddReference('ProtoGeometry')
from Autodesk.DesignScript.Geometry import *

# The inputs to this node will be stored as a list in the IN variables.
dataEnteringNode = IN

# Place your code below this line
import numpy as np
import pandas as pd
from scipy.stats import gmean

def fuzzy(parameter,data):

   l=len(data)
   geoMean=pd.DataFrame()
   criteria=[]
   for name in data.columns:
       if name[0] not in  criteria:
           criteria.append(name[0])
   for i in list(range(1,l+1)):
      temp=0
      for j in [1,2,3]:
           temp=gmean([data.loc[i-1,(criteria[k],str(j))] for k in range(len(criteria))])
           geoMean.loc[i-1,str(j)]=temp
   a=geoMean.sum(axis=0).transpose()
   geoMean=pd.concat([geoMean,pd.DataFrame(a).transpose()],ignore_index=True)
   geoMean=pd.concat([geoMean,pd.DataFrame(1/geoMean.iloc[-1,:]).transpose()],ignore_index=True)
   geoStat=[min(geoMean.iloc[-1]),geoMean.iloc[-1].mean(),geoMean.iloc[-1].max()]
   fuzzyW=pd.DataFrame()
   for j in range(l):
      temp=[geoMean.iloc[j,i]*geoStat[i] for i in range(3)]
      fuzzyW=pd.concat([fuzzyW,pd.DataFrame(temp).transpose()],ignore_index=True)
   fuzzyW["MI"]=fuzzyW.mean(axis=1)
   fuzzyW["Nor"]=fuzzyW["MI"]/fuzzyW["MI"].sum(axis=0)
   return(fuzzyW)
   
def matrix_prep(inp):
   D_csv=pd.DataFrame(inp[1:])
   columns_D=D_csv.iloc[0][1:]
   columns=[]
   for main_column in columns_D:
       for i in [1,2,3]:        
          columns.append((main_column,str(i)))
   D_data=D_csv.iloc[1:]
   D_data=D_data.drop(D_data.columns[0],axis=1)
   k_1=[]
   k_2=[]
   for i in range(len(D_data)):
       new_n=[]
       new_n2=[]
       for n_list in D_data.iloc[i]:
           new_n.append([float(x) for x in str(n_list).split(" ") if x!=""])
           new_n2.append(sorted([1/float(x) for x in str(n_list).split(" ") if x!=""]))
       k_1.append(new_n)
       k_2.append(new_n2)
   for i in range(len(k_1)):
       for j in range(len(k_1[i])):
           if j<i:
               k_1[i][j]=k_2[j][i]
   k_f=[]
   for row in k_1:
       k_f.append([item for sublist in row for item in sublist])
   k_f=pd.DataFrame(k_f)
   k_f.columns=pd.MultiIndex.from_tuples(columns)
   return(k_f)

d_matrixes=[]
fuzzyW_Ds=[]
f_matrixes=[]
fs_fuzzy=[]
for i in range(7):
    d_matrixes.append(matrix_prep(IN[i+1]))
    fuzzyW_Ds.append(fuzzy("f",d_matrixes[i]))
    
subs=[[1,2],[3,4,5,6],[7,8,9,10],[11,12,13,14,15],[16,17,18],[19],[20,21]]
k=0
for i in range(len(subs)):
    temp_f_matrixes=[]
    temp_fs_fuzzy=[]
    for j in range(len(subs[i])): 
        temp_f_matrixes.append(matrix_prep(IN[k+8]))
        temp_fs_fuzzy.append(fuzzy("ALT",temp_f_matrixes[j]))
        
        k=k+1
    f_matrixes.append(temp_f_matrixes)
    fs_fuzzy.append(temp_fs_fuzzy)
    
d_matrix=matrix_prep(IN[0])   
fuzzyW_D=fuzzy("D",d_matrix)

final=pd.DataFrame()
for i in range(len(fs_fuzzy)):
    for j in range(len(fs_fuzzy[i])):
       temp=pd.DataFrame([fuzzyW_D["Nor"][i]*fuzzyW_Ds[i]["Nor"][j],fuzzyW_D["Nor"][i]*fuzzyW_Ds[i]["Nor"][j]*fs_fuzzy[i][j]["Nor"][0],fuzzyW_D["Nor"][i]*fuzzyW_Ds[i]["Nor"][j]*fs_fuzzy[i][j]["Nor"][1]]).transpose()
       final=pd.concat([final,temp],ignore_index=True)

rank="1st Alternative Rank is " +str(round(final.iloc[:,1].sum(),3))+"\n2nd Alternative Rank is " +str(round(final.iloc[:,2].sum(),3))
    
#Assign your output to the OUT variable.
OUT = rank
# ----------------------------------------
python_script_4 = Python(IN[0]=python_script_3)  # CPython3
# ---------- python_script_4.python (51 lines) ----------
# Load the Python Standard and DesignScript Libraries
import clr
clr.AddReference('System.Windows.Forms')
clr.AddReference('System.Drawing')
clr.AddReference('ProtoGeometry')
from Autodesk.DesignScript.Geometry import *

# The inputs to this node will be stored as a list in the IN variables.
dataEnteringNode = IN
from System.Windows.Forms import Form, Label, Button, TextBox, TreeView, TreeNode
from System.Drawing import Point, Size

# Define a global variable to store the selected items
selected_items = []

class MyForm(Form):
    def __init__(self):
        # Initialize the form
        self.Text = "User Input Form"
        self.ClientSize = Size(350, 400)

        # Create a label for the text input
        self.text_label = Label()
        self.text_label.Text = IN[0]
        self.text_label.Location = Point(20, 20)
        self.text_label.AutoSize = True
        self.Controls.Add(self.text_label)


        # Create a button to submit the input
        self.submit_button = Button()
        self.submit_button.Text = "Calculate"
        self.submit_button.Location = Point(20, 320)
        self.submit_button.Click += self.submit_button_click
        self.Controls.Add(self.submit_button)

    def submit_button_click(self, sender, args):
        # Event handler for submit button click

        self.Close()

        

# Create an instance of the form
form = MyForm()
form.ShowDialog()


#return (Autodesk.Revit.UI.Result.Succeeded)
# Assign your output to the OUT variable.
OUT =0
# ----------------------------------------
code_block_51 = CodeBlock {  }
python_script_5 = Python(IN[0]=watch)  # CPython3
# ---------- python_script_5.python (109 lines) ----------
# Load the Python Standard and DesignScript Libraries
import sys
import clr
clr.AddReference('ProtoGeometry')
clr.AddReference('System.Windows.Forms')
clr.AddReference('System.Drawing')
from Autodesk.DesignScript.Geometry import *
from System.Windows.Forms import Form, Label, Button, TextBox, ComboBox, TreeNode, TreeView
from System.Drawing import Point, Size
# The inputs to this node will be stored as a list in the IN variables.
dataEnteringNode = IN

# Place your code below this line
familyList=IN[0]
familyName=[str(x) for x in familyList]
familyDict=dict(zip(familyName,familyList))

class MyForm(Form):
    def __init__(self):
        # Initialize the form
        self.Text = "Importance Selection Menue"
        self.ClientSize = Size(750, 900)
        
        self.dropdowns=[]

        # Create a label for the whole menu
        self.dropdown_label = Label()
        self.dropdown_label.Text = "Select Importance of Each Criteria and its Subs:"
        self.dropdown_label.Location = Point(20, 20)
        self.dropdown_label.AutoSize = True
        self.Controls.Add(self.dropdown_label)
        
        subs=[[1,2],[3,4,5,6],[7,8,9,10],[11,12,13,14,15],[16,17,18],[19],[20,21]]
        mainNames=["Project Charechteristic","Supply Chain","Time","Cost","Quality","Procurement","Socio-cultural"]
        subNames=[["Location","Project Design"],["Financing","Available Manufactorer","Available Infrastructure","Experts/Skilled Workers"],["Design Period","Production Time","Mobilization/Transfer time","Assembly/Construction period"],["Design","Manufacturing","Logistics","Assembly/Construction","Maintenance"],["DfMA + disassembly","Standards/Protocols","Sustainability"],["Procurement/delivery method"],["Cultural resistance","Local authority regulation"]]
        startY=40
        for i in range(len(subs)):
           if i<3:
               startX=20
           elif i==3:
               startY=40 
               startX=300  
           elif i==6:
               startY=40
               startX=550 
           else:
               startX=300
           
           # Create a label for D
           self.dropdown_label = Label()
           self.dropdown_label.Text = "D"+str(i+1)+": "+mainNames[i]
           self.dropdown_label.Location = Point(startX, startY+5)
           self.dropdown_label.AutoSize = True
           self.Controls.Add(self.dropdown_label)
        
           # Create a dropdown (combobox) for the user input
           self.dropdown = ComboBox()
           self.dropdown.Location = Point(startX+30, startY+30)
           self.dropdown.Size = Size(100, 20)
           self.dropdown.Items.AddRange(["L", "M", "H", "VH"])  # Predefined options
           self.Controls.Add(self.dropdown) 
           startY=startY+60
        
           for k in range(len(subs[i])):
              # Create a label for D2
              self.dropdown_label = Label()
              self.dropdown_label.Text = "F"+str(subs[i][k])+": "+subNames[i][k]
              self.dropdown_label.Location = Point(startX+20, startY+5)
              self.dropdown_label.AutoSize = True
              self.Controls.Add(self.dropdown_label)
        
              # Create a dropdown (combobox) for the user input
              self.dropdown = ComboBox()
              self.dropdown.Location = Point(startX+50, startY+30)
              self.dropdown.Size = Size(80, 20)
              self.dropdown.Items.AddRange(["L", "M", "H", "VH"])  # Predefined options
              self.Controls.Add(self.dropdown)
              # Add the dropdown to the list
              self.dropdowns.append(self.dropdown)  
              startY=startY+60
           startY=startY+15

        # Create a button to submit the input
        self.submit_button = Button()
        self.submit_button.Text = "Submit"
        self.submit_button.Location = Point(600, 822)
        self.submit_button.Click += self.submit_button_click
        self.Controls.Add(self.submit_button)

    def submit_button_click(self, sender, args):
        # Event handler for submit button click
        global inputs
        inputs=[]
        # Get selected nodes from the treeview recursively
        for dropdown in self.dropdowns:
            inputs.append(dropdown.SelectedItem)
        d1 = self.dropdown.Text
        #close the window
        self.Close()



# Create an instance of the form
form = MyForm()
form.ShowDialog()


# Assign your output to the OUT variable.
OUT = inputs
# ----------------------------------------
python_script_6 = Python(IN[0]=watch)  # CPython3; frozen
# ---------- python_script_6.python (61 lines) ----------
# Load the Python Standard and DesignScript Libraries
import sys
import clr
clr.AddReference('ProtoGeometry')
from Autodesk.DesignScript.Geometry import *

# The inputs to this node will be stored as a list in the IN variables.
dataEnteringNode = IN

# Place your code below this line
import clr
clr.AddReference('System.Windows.Forms')
clr.AddReference('System.Drawing')

from System.Windows.Forms import Form, Label, Button, ComboBox
from System.Drawing import Point, Size

class MyForm(Form):
    def __init__(self):
        # Initialize the form
        self.Text = "User Input Form"
        self.ClientSize = Size(350, 400)
        self.dropdowns = []  # List to hold dropdown controls

        # Create and populate dropdowns dynamically
        for i in range(3):  # Create 3 dropdowns
            label = Label()
            label.Text = f"Dropdown {i + 1}:"
            label.Location = Point(20, 20 + 70 * i)
            label.AutoSize = True
            self.Controls.Add(label)

            dropdown = ComboBox()
            dropdown.Location = Point(20, 40 + 70 * i)
            dropdown.Size = Size(200, 20)
            dropdown.Items.AddRange(["Option 1", "Option 2", "Option 3"])  # Predefined options
            self.Controls.Add(dropdown)
            self.dropdowns.append(dropdown)  # Add the dropdown to the list

        # Create a button to submit the input
        self.submit_button = Button()
        self.submit_button.Text = "Submit"
        self.submit_button.Location = Point(20, 320)
        self.submit_button.Click += self.submit_button_click
        self.Controls.Add(self.submit_button)

    def submit_button_click(self, sender, args):
        # Event handler for submit button click
        global selected_values
        selected_values = []
        # Iterate through the list of dropdowns and retrieve selected values
        for dropdown in self.dropdowns:
            selected_values.append(dropdown.SelectedItem)
        print("Selected values:", selected_values)

# Create an instance of the form
form = MyForm()
form.ShowDialog()

# Assign your output to the OUT variable.
OUT = selected_values
# ----------------------------------------
code_block_52 = CodeBlock(In_D=remember) { a=In_D; ["F1","F2"]; ["F3","F4","F5","F6"]; }
python_script_7 = Python(IN[0]=code_block_52.out1, IN[1]=code_block_52.out2)  # CPython3
# ---------- python_script_7.python (137 lines) ----------
# Load the Python Standard and DesignScript Libraries
import sys
import clr
clr.AddReference('ProtoGeometry')
from Autodesk.DesignScript.Geometry import *

# The inputs to this node will be stored as a list in the IN variables.
dataEnteringNode = IN

# Place your code below this line
import clr
clr.AddReference('System.Windows.Forms')
clr.AddReference('System.Drawing')

import pandas as pd
from System.Windows.Forms import Form, Button, DataGridView, DataGridViewAutoSizeColumnsMode, DataGridViewTextBoxColumn,Label,PictureBox
from System.Drawing import Point, Size, Image, Bitmap

def create_form_with_table(column_names):
    class DynamicForm(Form):
        def __init__(self):
            # Initialize the form
            self.Text = "Dynamic Table Input Form"
            self.ClientSize = Size((len(column_names)+1)*150, len(column_names)*28+170)
            
            # Create a label for the whole menu
            self.dropdown_label = Label()
            self.dropdown_label.Text = "Select Importance of Each Criteria :"
            self.dropdown_label.Location = Point(20, 20)
            self.dropdown_label.AutoSize = True
            self.Controls.Add(self.dropdown_label)

            # Create a DataGridView for table input
            self.dataGridView = DataGridView()
            self.dataGridView.Location = Point(20, 40)
            self.dataGridView.Size = Size((len(column_names)+1)*140, len(column_names)*28+20)
            self.dataGridView.AutoGenerateColumns = False

            # Define columns based on column_names
            for i, row in enumerate(self.dataGridView.Rows):
                row.HeaderCell.Value = column_names[i]
            column = DataGridViewTextBoxColumn()
            column.HeaderText = " "
            self.dataGridView.Columns.Add(column)    
            for col_name in column_names:
                column = DataGridViewTextBoxColumn()
                column.HeaderText = col_name
                self.dataGridView.Columns.Add(column)

            self.dataGridView.AutoSizeColumnsMode = DataGridViewAutoSizeColumnsMode.Fill
            self.Controls.Add(self.dataGridView)
                    # Set default values for some cells
            global row_values
            for i in range(len(column_names)):
                row_values=["" for _ in range(len(column_names))]
                row_values[i]="1 1 1"
                row_values[0:i]=["NA"]*i
                row_values.insert(0, column_names[i])
                self.dataGridView.Rows.Add(row_values)

            # Set row headers visible and read-only
            self.dataGridView.RowHeadersVisible = True
            
            #for row in self.dataGridView.Rows:
             #   row.HeaderCell.ReadOnly = True
            # Create a button to submit the input
            self.submit_button = Button()
            self.submit_button.Text = "Submit"
            self.submit_button.Location = Point((len(column_names)+1)*120, len(column_names)*28+80)
            self.submit_button.Click += self.submit_button_click
            self.Controls.Add(self.submit_button)
            
            # Create Help buttons
            self.help_button1 = Button()
            self.help_button1.Text = "Factors' Definition"
            self.help_button1.Location = Point(25, len(column_names)*28+80)
            self.help_button1.Size=Size(135,20)
            self.help_button1.Click += self.help_button1_click
            self.Controls.Add(self.help_button1)

            self.help_button2 = Button()
            self.help_button2.Text = "Scoring Assistance"
            self.help_button2.Location = Point(25, len(column_names)*28+100)
            self.help_button2.Size=Size(135,20)
            self.help_button2.Click += self.help_button2_click
            self.Controls.Add(self.help_button2)

            # PictureBox for displaying photo
            self.picture_box = PictureBox()
            self.picture_box.Location = Point(20, 260)
            self.picture_box.Size = Size(500, 100)
            self.Controls.Add(self.picture_box)

            # Load initial photo
            #self.picture_box.Image = Image.FromFile("photo1.jpg")

        def submit_button_click(self, sender, args):
            # Event handler for submit button click
            global data
            data = []
            # Iterate through rows in DataGridView and retrieve cell values
            for row in self.dataGridView.Rows:
                values = []
                for cell in row.Cells:
                    values.append(cell.Value)
                data.append(values)
            self.Close()
        def help_button1_click(self, sender, args):
            # Event handler for help button 1 click
            #self.picture_box.Image = Image.FromFile(r"C:\Users\narim\Desktop\profile photo.jpg")
            a=1

        def help_button2_click(self, sender, args):
            # Event handler for help button 2 click
            #self.picture_box.Image = Image.FromFile("photo2.jpg")
            a=1

            # Convert the data to a pandas DataFrame
            


    # Create an instance of the dynamic form
    form = DynamicForm()
    form.ShowDialog()

# Example usage:
subfactors=[[1,2],[3,4,5,6],[7,8,9,10],[11,12,13,14,15],[16,17,18],[19],[20,21]]
inputList=[]
for main in subfactors:
    column_names=["F"+str(x) for x in main]
    create_form_with_table(column_names)
    data=data[:-1]
    inputList.append(data)


# Assign your output to the OUT variable.
OUT = inputList
# ----------------------------------------
python_script_8 = Python(IN[0]=code_block_52.out1, IN[1]=code_block_52.out2)  # CPython3
# ---------- python_script_8.python (150 lines) ----------
# Load the Python Standard and DesignScript Libraries
import sys
import clr
clr.AddReference('ProtoGeometry')
from Autodesk.DesignScript.Geometry import *

# The inputs to this node will be stored as a list in the IN variables.
dataEnteringNode = IN

# Place your code below this line
import clr
clr.AddReference('System.Windows.Forms')
clr.AddReference('System.Drawing')

import pandas as pd
from System.Windows.Forms import Form, Button, DataGridView, DataGridViewAutoSizeColumnsMode, DataGridViewTextBoxColumn,Label,PictureBox
from System.Drawing import Point, Size, Image, Bitmap

def create_form_with_table(subFactors,index):
    class DynamicForm(Form):
        def __init__(self):
            # Initialize the form
            column_names=["ALT1","ALT2"]
            self.Text = "Dynamic Table Input Form"
            self.ClientSize = Size(400, len(subFactors)*120+170)
            startX=20
            startY=5
            inputData=[]
            # Create a label for the whole menu
            self.dropdown_label = Label()
            self.dropdown_label.Text = "D"+str(index+1)
            self.dropdown_label.Location = Point(startX, startY)
            self.dropdown_label.AutoSize = True
            self.Controls.Add(self.dropdown_label)
            for i in range(len(subFactors)):
                # Create a label for the whole menu
                self.dropdown_label = Label()
                self.dropdown_label.Text = "F"+str(subFactors[i])
                self.dropdown_label.Location = Point(startX, startY+30)
                self.dropdown_label.AutoSize = True
                self.Controls.Add(self.dropdown_label)

                # Create a DataGridView for table input
                self.dataGridView = DataGridView()
                self.dataGridView.Location = Point(startX, startY+55)
                self.dataGridView.Size = Size(350,70)
                self.dataGridView.AutoGenerateColumns = False
 
                # Define columns based on column_names
                for i, row in enumerate(self.dataGridView.Rows):
                    row.HeaderCell.Value = column_names[i]
                column = DataGridViewTextBoxColumn()
                column.HeaderText = " "
                self.dataGridView.Columns.Add(column)    
                for col_name in column_names:
                    column = DataGridViewTextBoxColumn()
                    column.HeaderText = col_name
                    self.dataGridView.Columns.Add(column)

                self.dataGridView.AutoSizeColumnsMode = DataGridViewAutoSizeColumnsMode.Fill
                self.Controls.Add(self.dataGridView)
                    # Set default values for some cells
                global row_values
                for i in range(len(column_names)):
                   row_values=["" for _ in range(len(column_names))]
                   row_values[i]="1 1 1"
                   row_values[0:i]=["NA"]*i
                   row_values.insert(0, column_names[i])
                   self.dataGridView.Rows.Add(row_values)

                # Set row headers visible and read-only
                self.dataGridView.RowHeadersVisible = True
                startY=startY+120
            
                #for row in self.dataGridView.Rows:
                #   row.HeaderCell.ReadOnly = True
            # Create a button to submit the input
            self.submit_button = Button()
            self.submit_button.Text = "Submit"
            self.submit_button.Location = Point(300, len(subFactors)*115+50)
            self.submit_button.Click += self.submit_button_click
            self.Controls.Add(self.submit_button)
            
            # Create Help buttons
            self.help_button1 = Button()
            self.help_button1.Text = "Factors' Definition"
            self.help_button1.Location = Point(25, len(subFactors)*115+50)
            self.help_button1.Size=Size(135,20)
            self.help_button1.Click += self.help_button1_click
            self.Controls.Add(self.help_button1)

            self.help_button2 = Button()
            self.help_button2.Text = "Scoring Assistance"
            self.help_button2.Location = Point(25, len(subFactors)*115+70)
            self.help_button2.Size=Size(135,20)
            self.help_button2.Click += self.help_button2_click
            self.Controls.Add(self.help_button2)

            # PictureBox for displaying photo
            self.picture_box = PictureBox()
            self.picture_box.Location = Point(20, 260)
            self.picture_box.Size = Size(500, 100)
            self.Controls.Add(self.picture_box)

            # Load initial photo
            #self.picture_box.Image = Image.FromFile("photo1.jpg")

        def submit_button_click(self, sender, args):
            # Event handler for submit button click
            global data
            data = []
            # Iterate through rows in DataGridView and retrieve cell values
            for control in self.Controls:
                if isinstance(control, DataGridView):
                    gridData=[]
                    for row in control.Rows:
                        values = []
                        for cell in row.Cells:
                           values.append(cell.Value)
                        gridData.append(values)
                    data.append(gridData[:-1])
            self.Close()
        def help_button1_click(self, sender, args):
            # Event handler for help button 1 click
            #self.picture_box.Image = Image.FromFile(r"C:\Users\narim\Desktop\profile photo.jpg")
            a=1

        def help_button2_click(self, sender, args):
            # Event handler for help button 2 click
            #self.picture_box.Image = Image.FromFile("photo2.jpg")
            a=1

            # Convert the data to a pandas DataFrame
            


    # Create an instance of the dynamic form
    form = DynamicForm()
    form.ShowDialog()

# Example usage:
subFactors=[[1,2],[3,4,5,6],[7,8,9,10],[11,12,13,14,15],[16,17,18],[19],[20,21]]
inputList=[]
for i in range(len(subFactors)):
    create_form_with_table(subFactors[i],i)
    inputList.append(data)


# Assign your output to the OUT variable.
OUT = inputList
# ----------------------------------------
python_script_9 = Python()  # CPython3; frozen; unwired: IN[0]
# ---------- python_script_9.python (81 lines) ----------
import clr
clr.AddReference('System.Windows.Forms')
clr.AddReference('System.Drawing')

import pandas as pd
from System.Windows.Forms import Form, Button, DataGridView, DataGridViewAutoSizeColumnsMode, DataGridViewTextBoxColumn, DataGridViewRowHeadersWidthSizeMode, FormStartPosition
from System.Drawing import Point, Size

def create_form_with_table_input(num_table_inputs):
    class DynamicForm(Form):
        def __init__(self, num_inputs):
            # Initialize the form
            self.Text = "Dynamic Table Input Form"
            self.ClientSize = Size(400, 300)
            self.StartPosition = FormStartPosition.CenterScreen

            # Create table inputs based on num_inputs
            for i in range(num_inputs):
                # Create a DataGridView for table input
                data_grid_view = DataGridView()
                data_grid_view.Location = Point(20, 20 + i * 120)
                data_grid_view.Size = Size(350, 100)
                data_grid_view.AutoGenerateColumns = False

                # Define columns
                column1 = DataGridViewTextBoxColumn()
                column1.HeaderText = "Column 1"
                column2 = DataGridViewTextBoxColumn()
                column2.HeaderText = "Column 2"
                column3 = DataGridViewTextBoxColumn()
                column3.HeaderText = "Column 3"

                # Add columns to the DataGridView
                data_grid_view.Columns.Add(column1)
                data_grid_view.Columns.Add(column2)
                data_grid_view.Columns.Add(column3)

                data_grid_view.AutoSizeColumnsMode = DataGridViewAutoSizeColumnsMode.Fill
                self.Controls.Add(data_grid_view)

            # Create a button to submit the input
            self.submit_button = Button()
            self.submit_button.Text = "Submit"
            self.submit_button.Location = Point(20, 220)
            self.submit_button.Click += self.submit_button_click
            self.Controls.Add(self.submit_button)

        def submit_button_click(self, sender, args):
            # Event handler for submit button click
            global data
            data = []
            # Iterate through DataGridViews and retrieve cell values
            for control in self.Controls:
                if isinstance(control, DataGridView):
                    grid_data = []
                    for row in control.Rows:
                        values = []
                        for cell in row.Cells:
                            values.append(cell.Value)
                        grid_data.append(values)
                    data.append(grid_data)

            # Convert the data to a pandas DataFrame
            dfs = [pd.DataFrame(grid_data, columns=["Column 1", "Column 2", "Column 3"]) for grid_data in data]
            print("User input DataFrames:")
            for i, df in enumerate(dfs):
                print(f"Form {i+1}:")
                print(df)

            # Close the current form
            self.Close()

    # Create an instance of the dynamic form
    form = DynamicForm(num_table_inputs)
    form.ShowDialog()

# Example usage:
num_table_inputs_list = [2, 3, 1]  # Number of table inputs for each form
for num_table_inputs in num_table_inputs_list:
    create_form_with_table_input(num_table_inputs)
OUT=data
# ----------------------------------------
